# Dynamo graph DYNAMO_MODELO_NATIVO_HOGAR_REFUGIO.dyn (Dynamo 3.0.0.0)
# Modelo nativo del Hogar de Refugio Temporal (CUI 2675514)

boolean = BoolSelector(true)
modelo_nativo_hogar_de_refugio = Python(IN[0]=boolean)  # CPython3
# ---------- modelo_nativo_hogar_de_refugio.python (423 lines) ----------
DATOS_JSON = r'''{"edificios":[{"cod":"E-01","nombre":"ADMINISTRACIÓN","npt":0.15,"piso":[12.575,25.259,32.775,49.959],"muros":[[14.515,26.524,31.045,26.524,0.13,0.15,3.7,true],[13.775,30.194,15.044,30.194,0.13,0.15,3.7,false],[14.065,32.024,20.335,32.024,0.13,0.15,3.7,false],[25.015,32.024,31.285,32.024,0.13,0.15,3.7,false],[24.715,37.574,31.285,37.574,0.13,0.15,3.7,false],[14.065,37.694,20.635,37.694,0.13,0.15,3.7,false],[13.775,39.254,17.445,39.254,0.13,0.15,3.7,false],[17.445,39.864,20.945,39.864,0.13,0.15,3.7,false],[24.275,40.359,31.575,40.359,0.13,0.15,3.7,false],[13.775,40.814,16.515,40.814,0.13,0.15,3.7,false],[14.065,43.024,20.335,43.024,0.13,0.15,3.7,false],[25.015,43.144,31.285,43.144,0.13,0.15,3.7,false],[14.515,48.694,20.635,48.694,0.13,0.15,3.7,true],[21.115,48.694,30.835,48.694,0.13,0.15,3.7,true],[13.84,27.199,13.84,37.169,0.13,0.15,3.7,true],[13.84,37.949,13.84,48.019,0.13,0.15,3.7,true],[15.839,30.129,15.839,32.089,0.13,0.15,3.7,false],[16.45,39.319,16.45,42.959,0.13,0.15,3.7,false],[17.51,37.629,17.51,39.929,0.13,0.15,3.7,false],[21.01,26.709,21.01,39.929,0.13,0.15,3.7,false],[21.01,43.489,21.01,48.469,0.13,0.15,3.7,false],[24.34,28.85,24.34,29.95,0.13,0.15,3.7,false],[24.34,32.039,24.34,43.129,0.13,0.15,3.7,false],[27.84,31.959,27.84,37.639,0.13,0.15,3.7,false],[27.84,43.209,27.84,48.759,0.13,0.15,3.7,false],[31.51,27.199,31.51,37.169,0.13,0.15,3.7,true],[31.51,37.949,31.51,42.919,0.13,0.15,3.7,true],[31.51,43.449,31.51,48.019,0.13,0.15,3.7,true]],"vigas":[[14.515,26.524,31.045,26.524,0.15,3.44,3.7],[13.775,30.194,15.044,30.194,0.15,3.44,3.7],[14.065,32.024,20.335,32.024,0.15,3.44,3.7],[25.015,32.024,31.285,32.024,0.15,3.44,3.7],[24.715,37.574,31.285,37.574,0.15,3.44,3.7],[14.065,37.694,20.635,37.694,0.15,3.44,3.7],[13.775,39.254,17.445,39.254,0.15,3.44,3.7],[17.445,39.864,20.945,39.864,0.15,3.44,3.7],[24.275,40.359,31.575,40.359,0.15,3.44,3.7],[13.775,40.814,16.515,40.814,0.15,3.44,3.7],[14.065,43.024,20.335,43.024,0.15,3.44,3.7],[25.015,43.144,31.285,43.144,0.15,3.44,3.7],[14.515,48.694,20.635,48.694,0.15,3.44,3.7],[21.115,48.694,30.835,48.694,0.15,3.44,3.7],[13.84,27.199,13.84,37.169,0.15,3.44,3.7],[13.84,37.949,13.84,48.019,0.15,3.44,3.7],[15.839,30.129,15.839,32.089,0.15,3.44,3.7],[16.45,39.319,16.45,42.959,0.15,3.44,3.7],[17.51,37.629,17.51,39.929,0.15,3.44,3.7],[21.01,26.709,21.01,39.929,0.15,3.44,3.7],[21.01,43.489,21.01,48.469,0.15,3.44,3.7],[24.34,28.85,24.34,29.95,0.15,3.44,3.7],[24.34,32.039,24.34,43.129,0.15,3.44,3.7],[27.84,31.959,27.84,37.639,0.15,3.44,3.7],[27.84,43.209,27.84,48.759,0.15,3.44,3.7],[31.51,27.199,31.51,37.169,0.15,3.44,3.7],[31.51,37.949,31.51,42.919,0.15,3.44,3.7],[31.51,43.449,31.51,48.019,0.15,3.44,3.7]],"columnas":[[13.9,32.009,0.25,0.4,0.15,3.7],[13.9,37.559,0.25,0.7,0.15,3.7],[13.9,43.159,0.25,0.4,0.15,3.7],[20.875,26.584,0.4,0.25,0.15,3.7],[20.875,37.634,0.4,0.25,0.15,3.7],[20.875,48.634,0.4,0.25,0.15,3.7],[24.475,26.584,0.4,0.25,0.15,3.7],[24.475,37.634,0.4,0.25,0.15,3.7],[24.475,48.634,0.4,0.25,0.15,3.7],[31.45,32.009,0.25,0.4,0.15,3.7],[31.45,37.559,0.25,0.7,0.15,3.7],[31.45,43.159,0.25,0.4,0.15,3.7]],"puertas":[{"cod":"P-13","x":21.01,"y":27.166,"o":"V","ancho":0.895,"alto":2.5,"sill":0.15,"sobreluz":0.785,"vidrio":false,"via":"vano","muro":19},{"cod":"P-13","x":28.37,"y":32.024,"o":"H","ancho":0.9,"alto":2.5,"sill":0.15,"sobreluz":0.785,"vidrio":false,"via":"vano","muro":3},{"cod":"P-13","x":24.34,"y":38.224,"o":"V","ancho":0.9,"alto":2.5,"sill":0.15,"sobreluz":0.785,"vidrio":false,"via":"vano","muro":22},{"cod":"P-12","x":21.01,"y":36.894,"o":"V","ancho":1.2,"alto":2.5,"sill":0.15,"sobreluz":0.785,"vidrio":false,"via":"vano","muro":19},{"cod":"P-13","x":20.48,"y":39.864,"o":"H","ancho":0.9,"alto":2.5,"sill":0.15,"sobreluz":0.785,"vidrio":false,"via":"vano","muro":7},{"cod":"P-3","x":16.45,"y":42.444,"o":"V","ancho":1.0,"alto":2.5,"sill":0.15,"sobreluz":0.0,"vidrio":false,"via":"vano","muro":17},{"cod":"P-12","x":27.84,"y":45.859,"o":"V","ancho":1.2,"alto":2.5,"sill":0.15,"sobreluz":0.785,"vidrio":false,"via":"vano","muro":24},{"cod":"P-13","x":16.369,"y":32.024,"o":"H","ancho":0.9,"alto":2.5,"sill":0.15,"sobreluz":0.785,"vidrio":false,"via":"vano","muro":2},{"cod":"P-3","x":16.98,"y":39.254,"o":"H","ancho":0.91,"alto":2.5,"sill":0.15,"sobreluz":0.0,"vidrio":false,"via":"vano","muro":6},{"cod":"M-1","x":26.225,"y":48.694,"o":"H","ancho":3.07,"alto":3.29,"sill":0.15,"sobreluz":0.785,"vidrio":true,"via":"vano","muro":13},{"cod":"M-1","x":31.51,"y":30.259,"o":"V","ancho":3.07,"alto":3.29,"sill":0.15,"sobreluz":0.785,"vidrio":true,"via":"vano","muro":25},{"cod":"P-3","x":16.45,"y":40.034,"o":"V","ancho":1.0,"alto":2.5,"sill":0.15,"sobreluz":0.0,"vidrio":false,"via":"vano","muro":17},{"cod":"M-1","x":29.41,"y":26.52,"o":"H","ancho":3.07,"alto":3.29,"sill":0.15,"sobreluz":0.785,"vidrio":true,"via":"linea","muro":0},{"cod":"P-12","x":21.01,"y":44.189,"o":"V","ancho":1.2,"alto":2.5,"sill":0.15,"sobreluz":0.785,"vidrio":false,"via":"linea","muro":20},{"cod":"P-13","x":24.34,"y":42.579,"o":"V","ancho":0.9,"alto":2.5,"sill":0.15,"sobreluz":0.785,"vidrio":false,"via":"linea","muro":22},{"cod":"P-14","x":24.34,"y":29.4,"o":"V","ancho":0.9,"alto":2.5,"sill":0.15,"sobreluz":0.0,"vidrio":true,"via":"linea","muro":21},{"cod":"P-13","x":24.34,"y":32.589,"o":"V","ancho":0.9,"alto":2.5,"sill":0.15,"sobreluz":0.785,"vidrio":false,"via":"linea","muro":22},{"cod":"P-13","x":21.01,"y":31.414,"o":"V","ancho":0.9,"alto":2.5,"sill":0.15,"sobreluz":0.785,"vidrio":false,"via":"linea","muro":19}],"ventanas":[{"cod":"V-14","x":24.34,"y":41.102,"o":"V","ancho":1.295,"alto":0.79,"sill":2.65,"via":"vano","muro":22},{"cod":"V-11","x":13.84,"y":41.774,"o":"V","ancho":1.73,"alto":0.79,"sill":2.65,"via":"vano","muro":15},{"cod":"V-17","x":13.84,"y":38.694,"o":"V","ancho":0.93,"alto":0.79,"sill":2.65,"via":"vano","muro":15},{"cod":"V-14","x":24.34,"y":39.617,"o":"V","ancho":1.295,"alto":0.79,"sill":2.65,"via":"vano","muro":22},{"cod":"V-2","x":24.34,"y":34.754,"o":"V","ancho":2.67,"alto":1.99,"sill":1.45,"via":"vano","muro":22},{"cod":"V-10","x":30.06,"y":32.024,"o":"H","ancho":1.89,"alto":0.79,"sill":2.65,"via":"vano","muro":3},{"cod":"V-15","x":13.84,"y":30.889,"o":"V","ancho":1.201,"alto":0.79,"sill":2.65,"via":"vano","muro":14},{"cod":"V-1","x":13.84,"y":35.454,"o":"V","ancho":2.87,"alto":1.99,"sill":1.45,"via":"vano","muro":14},{"cod":"V-13","x":13.84,"y":40.034,"o":"V","ancho":1.37,"alto":0.79,"sill":2.65,"via":"vano","muro":15},{"cod":"V-6","x":26.52,"y":32.024,"o":"H","ancho":2.45,"alto":0.79,"sill":2.65,"via":"vano","muro":3},{"cod":"V-5","x":26.245,"y":26.524,"o":"H","ancho":2.5,"alto":1.99,"sill":1.45,"via":"vano","muro":0},{"cod":"V-12","x":21.01,"y":38.864,"o":"V","ancho":1.57,"alto":0.79,"sill":2.65,"via":"vano","muro":19},{"cod":"V-3","x":21.01,"y":33.84,"o":"V","ancho":2.621,"alto":0.79,"sill":2.65,"via":"vano","muro":19},{"cod":"V-8","x":18.669,"y":39.864,"o":"H","ancho":2.131,"alto":0.79,"sill":2.65,"via":"vano","muro":7},{"cod":"V-3","x":16.105,"y":48.694,"o":"H","ancho":2.62,"alto":0.79,"sill":2.65,"via":"vano","muro":12},{"cod":"V-3","x":29.245,"y":48.694,"o":"H","ancho":2.62,"alto":0.79,"sill":2.65,"via":"vano","muro":13},{"cod":"V-9","x":31.51,"y":39.247,"o":"V","ancho":2.036,"alto":0.79,"sill":2.65,"via":"vano","muro":26},{"cod":"V-1","x":18.92,"y":26.524,"o":"H","ancho":2.87,"alto":1.99,"sill":1.45,"via":"vano","muro":0},{"cod":"V-7","x":31.51,"y":41.547,"o":"V","ancho":2.186,"alto":0.79,"sill":2.65,"via":"vano","muro":26},{"cod":"V-1","x":31.51,"y":33.964,"o":"V","ancho":2.87,"alto":1.99,"sill":1.45,"via":"vano","muro":25},{"cod":"V-16","x":31.51,"y":27.954,"o":"V","ancho":0.95,"alto":0.79,"sill":2.65,"via":"vano","muro":25},{"cod":"V-2","x":13.84,"y":46.404,"o":"V","ancho":2.67,"alto":1.99,"sill":1.45,"via":"vano","muro":15},{"cod":"V-4","x":22.675,"y":48.694,"o":"H","ancho":2.56,"alto":1.99,"sill":1.45,"via":"vano","muro":13},{"cod":"V-4","x":22.675,"y":26.524,"o":"H","ancho":2.56,"alto":1.99,"sill":1.45,"via":"vano","muro":0},{"cod":"V-2","x":31.51,"y":46.404,"o":"V","ancho":2.67,"alto":1.99,"sill":1.45,"via":"vano","muro":27},{"cod":"V-3","x":13.84,"y":28.789,"o":"V","ancho":2.62,"alto":0.79,"sill":2.65,"via":"vano","muro":14}],"techos":[{"rect":[12.26,24.821,33.09,50.151],"base":3.7,"pend":0.3,"eje":"y"},{"rect":[20.39,31.924,24.96,43.244],"base":8.084,"pend":0.3,"eje":"y","sobretecho":true}],"hastiales":[[[13.775,26.534,3.7],[13.775,26.534,4.135],[22.675,26.534,6.805],[31.575,26.534,4.135],[31.575,26.534,3.7]],[[13.775,48.684,3.7],[13.775,48.684,4.135],[22.675,48.684,6.805],[31.575,48.684,4.135],[31.575,48.684,3.7]]],"aberturas_techo":[[21.09,32.224,24.26,42.944]],"celosias":[[[21.09,32.224,6.349],[21.09,42.944,6.349],[21.09,42.944,8.294],[21.09,32.224,8.294]],[[24.26,32.224,6.349],[24.26,42.944,6.349],[24.26,42.944,8.294],[24.26,32.224,8.294]],[[21.09,32.224,6.349],[22.675,32.224,6.824],[24.26,32.224,6.349],[24.26,32.224,8.294],[22.675,32.224,8.77],[21.09,32.224,8.294]],[[21.09,42.944,6.349],[22.675,42.944,6.824],[24.26,42.944,6.349],[24.26,42.944,8.294],[22.675,42.944,8.77],[21.09,42.944,8.294]]]},{"cod":"E-02","nombre":"","npt":0.15,"piso":[44.095,41.59,53.795,55.29],"muros":[[45.735,42.855,52.155,42.855,0.13,0.15,3.85,true],[45.585,48.525,52.33,48.525,0.13,0.15,3.85,false],[51.326,50.05,52.595,50.05,0.13,0.15,3.85,false],[45.735,54.025,52.155,54.025,0.13,0.15,3.85,true],[45.36,43.23,45.36,53.69,0.13,0.15,3.85,true],[50.531,48.63,50.531,50.115,0.13,0.15,3.85,false],[52.53,43.19,52.53,53.69,0.13,0.15,3.85,true]],"vigas":[[45.735,42.855,52.155,42.855,0.15,3.44,3.85],[45.585,48.525,52.33,48.525,0.15,3.44,3.85],[51.326,50.05,52.595,50.05,0.15,3.44,3.85],[45.735,54.025,52.155,54.025,0.15,3.44,3.85],[45.36,43.23,45.36,53.69,0.15,3.44,3.85],[50.531,48.63,50.531,50.115,0.15,3.44,3.85],[52.53,43.19,52.53,53.69,0.15,3.44,3.85]],"columnas":[[45.495,42.99,0.4,0.4,0.15,3.85],[45.42,48.39,0.25,0.4,0.15,3.85],[45.495,53.89,0.4,0.4,0.15,3.85],[48.945,42.915,0.4,0.25,0.15,3.85],[52.395,42.99,0.4,0.4,0.15,3.85],[48.945,48.465,0.4,0.25,0.15,3.85],[48.945,53.965,0.4,0.25,0.15,3.85],[52.395,53.89,0.4,0.4,0.15,3.85],[52.47,48.39,0.25,0.4,0.15,3.85]],"puertas":[{"cod":"P-1","x":52.53,"y":43.805,"o":"V","ancho":1.2,"alto":2.5,"sill":0.15,"sobreluz":0.785,"vidrio":false,"via":"vano","muro":6},{"cod":"P-1","x":45.36,"y":53.075,"o":"V","ancho":1.2,"alto":2.5,"sill":0.15,"sobreluz":0.785,"vidrio":false,"via":"vano","muro":4},{"cod":"P-1","x":52.53,"y":53.075,"o":"V","ancho":1.2,"alto":2.5,"sill":0.15,"sobreluz":0.785,"vidrio":false,"via":"vano","muro":6}],"ventanas":[{"cod":"V-21","x":45.36,"y":50.545,"o":"V","ancho":3.27,"alto":1.99,"sill":1.45,"via":"vano","muro":4},{"cod":"V-18","x":45.36,"y":45.689,"o":"V","ancho":4.361,"alto":0.79,"sill":2.65,"via":"vano","muro":4},{"cod":"V-19","x":47.22,"y":54.025,"o":"H","ancho":2.41,"alto":0.79,"sill":2.65,"via":"vano","muro":3},{"cod":"V-19","x":47.22,"y":42.855,"o":"H","ancho":2.41,"alto":0.79,"sill":2.65,"via":"vano","muro":0},{"cod":"V-19","x":50.67,"y":42.855,"o":"H","ancho":2.41,"alto":0.79,"sill":2.65,"via":"vano","muro":0},{"cod":"V-22","x":52.53,"y":51.162,"o":"V","ancho":2.036,"alto":0.79,"sill":2.65,"via":"vano","muro":6},{"cod":"V-23","x":52.53,"y":49.433,"o":"V","ancho":1.045,"alto":0.79,"sill":2.65,"via":"vano","muro":6},{"cod":"V-20","x":52.53,"y":46.285,"o":"V","ancho":3.17,"alto":1.99,"sill":1.45,"via":"vano","muro":6},{"cod":"V-19","x":50.67,"y":54.025,"o":"H","ancho":2.41,"alto":0.79,"sill":2.65,"via":"vano","muro":3}],"techos":[{"rect":[43.78,41.444,54.11,55.774],"base":3.85,"pend":0.3,"eje":"y"}],"hastiales":[[[45.295,42.865,3.85],[45.295,42.865,4.285],[48.945,42.865,5.38],[52.595,42.865,4.285],[52.595,42.865,3.85]],[[45.295,54.015,3.85],[45.295,54.015,4.285],[48.945,54.015,5.38],[52.595,54.015,4.285],[52.595,54.015,3.85]]],"aberturas_techo":[],"celosias":[]},{"cod":"E-03","nombre":"","npt":0.15,"piso":[44.095,31.11,60.809,39.31],"muros":[[45.735,32.375,59.155,32.375,0.13,0.15,3.85,true],[52.32,35.215,55.945,35.215,0.13,0.15,3.85,false],[45.735,38.045,59.195,38.045,0.13,0.15,3.85,true],[45.36,32.75,45.36,37.67,0.13,0.15,3.85,true],[48.86,32.6,48.86,37.82,0.13,0.15,3.85,false],[52.385,32.75,52.385,37.67,0.13,0.15,3.85,false],[55.88,32.6,55.88,37.82,0.13,0.15,3.85,false],[59.574,32.87,59.574,37.548,0.07,0.15,3.85,true]],"vigas":[[45.735,32.375,59.155,32.375,0.15,3.44,3.85],[52.32,35.215,55.945,35.215,0.15,3.44,3.85],[45.735,38.045,59.195,38.045,0.15,3.44,3.85],[45.36,32.75,45.36,37.67,0.15,3.44,3.85],[48.86,32.6,48.86,37.82,0.15,3.44,3.85],[52.385,32.75,52.385,37.67,0.15,3.44,3.85],[55.88,32.6,55.88,37.82,0.15,3.44,3.85],[59.574,32.87,59.574,37.548,0.09,3.44,3.85]],"columnas":[[45.495,32.51,0.4,0.4,0.15,3.85],[48.995,32.435,0.4,0.25,0.15,3.85],[45.495,37.91,0.4,0.4,0.15,3.85],[48.995,37.985,0.4,0.25,0.15,3.85],[52.445,32.51,0.25,0.4,0.15,3.85],[55.895,32.435,0.4,0.25,0.15,3.85],[52.445,37.91,0.25,0.4,0.15,3.85],[55.895,37.985,0.4,0.25,0.15,3.85],[59.395,32.51,0.4,0.4,0.15,3.85],[59.395,37.91,0.4,0.4,0.15,3.85]],"puertas":[{"cod":"P-1","x":49.81,"y":38.045,"o":"H","ancho":1.2,"alto":2.5,"sill":0.15,"sobreluz":0.785,"vidrio":false,"via":"vano","muro":2},{"cod":"P-1","x":48.18,"y":38.045,"o":"H","ancho":1.2,"alto":2.5,"sill":0.15,"sobreluz":0.785,"vidrio":false,"via":"vano","muro":2},{"cod":"P-11","x":54.133,"y":38.05,"o":"H","ancho":2.0,"alto":2.5,"sill":0.15,"sobreluz":0.0,"vidrio":false,"via":"linea","muro":2},{"cod":"P-11","x":57.645,"y":38.05,"o":"H","ancho":2.0,"alto":2.5,"sill":0.15,"sobreluz":0.0,"vidrio":false,"via":"linea","muro":2},{"cod":"P-11","x":54.133,"y":32.38,"o":"H","ancho":2.0,"alto":2.5,"sill":0.15,"sobreluz":0.0,"vidrio":false,"via":"linea","muro":0}],"ventanas":[{"cod":"V-26","x":46.65,"y":38.045,"o":"H","ancho":1.27,"alto":1.99,"sill":1.45,"via":"vano","muro":2},{"cod":"V-25","x":51.352,"y":38.045,"o":"H","ancho":1.295,"alto":0.79,"sill":2.65,"via":"vano","muro":2},{"cod":"V-24","x":57.645,"y":32.375,"o":"H","ancho":2.461,"alto":0.79,"sill":2.65,"via":"vano","muro":0},{"cod":"V-24","x":50.758,"y":32.375,"o":"H","ancho":2.485,"alto":0.79,"sill":2.65,"via":"vano","muro":0},{"cod":"V-27","x":45.36,"y":36.605,"o":"V","ancho":1.57,"alto":0.79,"sill":2.65,"via":"vano","muro":3},{"cod":"V-24","x":47.245,"y":32.375,"o":"H","ancho":2.46,"alto":0.79,"sill":2.65,"via":"vano","muro":0}],"techos":[{"rect":[43.78,31.024,61.11,39.854],"base":3.85,"pend":0.3,"eje":"x"}],"hastiales":[[[45.37,32.31,3.85],[45.37,32.31,4.216],[45.37,35.439,5.155],[45.37,38.11,4.353],[45.37,38.11,3.85]],[[59.534,32.31,3.85],[59.534,32.31,4.216],[59.534,35.439,5.155],[59.534,38.11,4.353],[59.534,38.11,3.85]]],"aberturas_techo":[],"celosias":[]},{"cod":"E-04","nombre":"","npt":0.15,"piso":[12.575,50.889,25.775,88.389],"muros":[[14.415,52.154,23.975,52.154,0.13,0.15,3.85,true],[14.065,57.954,24.285,57.954,0.13,0.15,3.85,false],[14.065,63.804,24.285,63.804,0.13,0.15,3.85,false],[14.065,69.404,18.745,69.404,0.13,0.15,3.85,false],[19.415,69.404,24.285,69.404,0.13,0.15,3.85,false],[13.775,70.584,15.601,70.584,0.13,0.15,3.85,false],[14.965,71.54,15.865,71.54,0.13,0.15,3.85,false],[19.245,71.544,24.445,71.544,0.13,0.15,3.85,false],[13.775,71.644,14.965,71.644,0.13,0.15,3.85,false],[13.775,72.704,19.375,72.704,0.13,0.15,3.85,false],[14.065,75.524,24.285,75.524,0.13,0.15,3.85,false],[14.065,81.324,24.285,81.324,0.13,0.15,3.85,false],[14.415,87.124,23.935,87.124,0.13,0.15,3.85,true],[13.84,52.729,13.84,86.549,0.13,0.15,3.85,true],[14.9,69.469,14.9,70.519,0.13,0.15,3.85,false],[14.9,71.709,14.9,75.459,0.13,0.15,3.85,false],[15.96,72.639,15.96,75.459,0.13,0.15,3.85,false],[17.324,72.639,17.324,73.319,0.13,0.15,3.85,false],[17.34,52.089,17.34,57.889,0.13,0.15,3.85,false],[19.31,69.629,19.31,75.339,0.13,0.15,3.85,false],[20.47,52.089,20.47,58.019,0.13,0.15,3.85,false],[21.85,69.339,21.85,71.609,0.13,0.15,3.85,false],[24.51,52.729,24.51,69.299,0.13,0.15,3.85,true],[24.51,69.894,24.51,71.609,0.13,0.15,3.85,true],[24.51,75.689,24.51,86.549,0.13,0.15,3.85,true]],"vigas":[[14.415,52.154,23.975,52.154,0.15,3.44,3.85],[14.065,57.954,24.285,57.954,0.15,3.44,3.85],[14.065,63.804,24.285,63.804,0.15,3.44,3.85],[14.065,69.404,18.745,69.404,0.15,3.44,3.85],[19.415,69.404,24.285,69.404,0.15,3.44,3.85],[13.775,70.584,15.601,70.584,0.15,3.44,3.85],[14.965,71.54,15.865,71.54,0.15,3.44,3.85],[19.245,71.544,24.445,71.544,0.15,3.44,3.85],[13.775,71.644,14.965,71.644,0.15,3.44,3.85],[13.775,72.704,19.375,72.704,0.15,3.44,3.85],[14.065,75.524,24.285,75.524,0.15,3.44,3.85],[14.065,81.324,24.285,81.324,0.15,3.44,3.85],[14.415,87.124,23.935,87.124,0.15,3.44,3.85],[13.84,52.729,13.84,86.549,0.15,3.44,3.85],[14.9,69.469,14.9,70.519,0.15,3.44,3.85],[14.9,71.709,14.9,75.459,0.15,3.44,3.85],[15.96,72.639,15.96,75.459,0.15,3.44,3.85],[17.324,72.639,17.324,73.319,0.15,3.44,3.85],[17.34,52.089,17.34,57.889,0.15,3.44,3.85],[19.31,69.629,19.31,75.339,0.15,3.44,3.85],[20.47,52.089,20.47,58.019,0.15,3.44,3.85],[21.85,69.339,21.85,71.609,0.15,3.44,3.85],[24.51,52.729,24.51,69.299,0.15,3.44,3.85],[24.51,69.894,24.51,71.609,0.15,3.44,3.85],[24.51,75.689,24.51,86.549,0.15,3.44,3.85]],"columnas":[[14.075,52.389,0.6,0.6,0.15,3.85],[13.9,57.939,0.25,0.4,0.15,3.85],[13.9,63.939,0.25,0.4,0.15,3.85],[13.9,69.539,0.25,0.4,0.15,3.85],[13.9,75.489,0.25,0.4,0.15,3.85],[13.9,81.189,0.25,0.4,0.15,3.85],[14.075,86.889,0.6,0.6,0.15,3.85],[19.175,52.214,0.4,0.25,0.15,3.85],[19.175,58.014,0.4,0.25,0.15,3.85],[19.175,63.864,0.4,0.25,0.15,3.85],[19.175,69.464,0.4,0.25,0.15,3.85],[19.175,75.464,0.4,0.25,0.15,3.85],[19.175,81.264,0.4,0.25,0.15,3.85],[19.175,87.064,0.4,0.25,0.15,3.85],[24.275,52.389,0.6,0.6,0.15,3.85],[24.45,57.939,0.25,0.4,0.15,3.85],[24.45,69.539,0.25,0.4,0.15,3.85],[24.275,86.889,0.6,0.6,0.15,3.85],[24.45,63.939,0.25,0.4,0.15,3.85],[24.45,75.489,0.25,0.4,0.15,3.85],[24.45,81.189,0.25,0.4,0.15,3.85]],"puertas":[{"cod":"P-2","x":23.46,"y":52.154,"o":"H","ancho":1.0,"alto":2.5,"sill":0.15,"sobreluz":0.785,"vidrio":false,"via":"vano","muro":0},{"cod":"P-2","x":19.89,"y":52.154,"o":"H","ancho":1.0,"alto":2.5,"sill":0.15,"sobreluz":0.785,"vidrio":false,"via":"vano","muro":0},{"cod":"P-1","x":24.51,"y":82.004,"o":"V","ancho":1.2,"alto":2.5,"sill":0.15,"sobreluz":0.785,"vidrio":false,"via":"vano","muro":24},{"cod":"P-1","x":24.51,"y":64.754,"o":"V","ancho":1.2,"alto":2.5,"sill":0.15,"sobreluz":0.785,"vidrio":false,"via":"vano","muro":22},{"cod":"P-1","x":24.51,"y":58.754,"o":"V","ancho":1.2,"alto":2.5,"sill":0.15,"sobreluz":0.785,"vidrio":false,"via":"vano","muro":22},{"cod":"P-1","x":24.51,"y":76.304,"o":"V","ancho":1.2,"alto":2.5,"sill":0.15,"sobreluz":0.785,"vidrio":false,"via":"vano","muro":24},{"cod":"P-2","x":19.31,"y":72.124,"o":"V","ancho":1.0,"alto":2.5,"sill":0.15,"sobreluz":0.785,"vidrio":false,"via":"vano","muro":19},{"cod":"P-2","x":19.31,"y":74.824,"o":"V","ancho":1.0,"alto":2.5,"sill":0.15,"sobreluz":0.785,"vidrio":false,"via":"vano","muro":19},{"cod":"P-4","x":21.32,"y":71.544,"o":"H","ancho":0.9,"alto":2.5,"sill":0.15,"sobreluz":0.785,"vidrio":false,"via":"vano","muro":7},{"cod":"P-2","x":23.93,"y":71.544,"o":"H","ancho":1.0,"alto":2.5,"sill":0.15,"sobreluz":0.785,"vidrio":false,"via":"vano","muro":7},{"cod":"P-2","x":16.677,"y":52.154,"o":"H","ancho":1.0,"alto":2.5,"sill":0.15,"sobreluz":0.785,"vidrio":false,"via":"vano","muro":0},{"cod":"P-8","x":14.9,"y":72.174,"o":"V","ancho":0.7,"alto":2.5,"sill":0.15,"sobreluz":0.0,"vidrio":false,"via":"vano","muro":15},{"cod":"P-8","x":14.9,"y":74.944,"o":"V","ancho":0.7,"alto":2.5,"sill":0.15,"sobreluz":0.0,"vidrio":false,"via":"vano","muro":15},{"cod":"P-8","x":15.96,"y":74.944,"o":"V","ancho":0.7,"alto":2.5,"sill":0.15,"sobreluz":0.0,"vidrio":false,"via":"vano","muro":16},{"cod":"P-8","x":15.415,"y":71.54,"o":"H","ancho":0.7,"alto":2.5,"sill":0.15,"sobreluz":0.0,"vidrio":false,"via":"linea","muro":6},{"cod":"P-8","x":14.9,"y":69.994,"o":"V","ancho":0.7,"alto":2.5,"sill":0.15,"sobreluz":0.0,"vidrio":false,"via":"linea","muro":14}],"ventanas":[{"cod":"V-38","x":13.84,"y":71.114,"o":"V","ancho":0.871,"alto":0.79,"sill":2.65,"via":"vano","muro":13},{"cod":"V-39","x":13.84,"y":70.275,"o":"V","ancho":0.431,"alto":0.79,"sill":2.65,"via":"vano","muro":13},{"cod":"V-29","x":13.84,"y":78.339,"o":"V","ancho":4.66,"alto":1.99,"sill":1.45,"via":"vano","muro":13},{"cod":"V-38","x":13.84,"y":72.174,"o":"V","ancho":0.871,"alto":0.79,"sill":2.65,"via":"vano","muro":13},{"cod":"V-30","x":13.84,"y":66.739,"o":"V","ancho":4.56,"alto":1.99,"sill":1.45,"via":"vano","muro":13},{"cod":"V-28","x":13.84,"y":60.939,"o":"V","ancho":4.96,"alto":1.99,"sill":1.45,"via":"vano","muro":13},{"cod":"V-26","x":15.329,"y":52.154,"o":"H","ancho":1.269,"alto":1.99,"sill":1.45,"via":"vano","muro":0},{"cod":"V-30","x":13.84,"y":83.989,"o":"V","ancho":4.56,"alto":1.99,"sill":1.45,"via":"vano","muro":13},{"cod":"V-37","x":18.045,"y":52.154,"o":"H","ancho":1.22,"alto":1.99,"sill":1.45,"via":"vano","muro":0},{"cod":"V-26","x":24.51,"y":70.694,"o":"V","ancho":1.27,"alto":1.99,"sill":1.45,"via":"vano","muro":23},{"cod":"V-35","x":13.84,"y":73.885,"o":"V","ancho":2.171,"alto":0.79,"sill":2.65,"via":"vano","muro":13},{"cod":"V-31","x":13.84,"y":55.214,"o":"V","ancho":4.41,"alto":1.99,"sill":1.45,"via":"vano","muro":13},{"cod":"V-31","x":24.51,"y":55.214,"o":"V","ancho":4.41,"alto":1.99,"sill":1.45,"via":"vano","muro":22},{"cod":"V-37","x":19.962,"y":71.544,"o":"H","ancho":1.225,"alto":1.99,"sill":1.45,"via":"vano","muro":7},{"cod":"V-32","x":24.51,"y":61.534,"o":"V","ancho":3.77,"alto":0.79,"sill":2.65,"via":"vano","muro":22},{"cod":"V-33","x":24.51,"y":78.934,"o":"V","ancho":3.47,"alto":0.79,"sill":2.65,"via":"vano","muro":24},{"cod":"V-36","x":21.615,"y":52.154,"o":"H","ancho":2.1,"alto":1.99,"sill":1.45,"via":"vano","muro":0},{"cod":"V-34","x":24.51,"y":84.584,"o":"V","ancho":3.37,"alto":0.79,"sill":2.65,"via":"vano","muro":24},{"cod":"V-34","x":24.51,"y":67.334,"o":"V","ancho":3.37,"alto":0.79,"sill":2.65,"via":"vano","muro":22}],"techos":[{"rect":[12.26,50.574,26.09,88.704],"base":3.85,"pend":0.3,"eje":"y"}],"hastiales":[[[13.775,52.164,3.85],[13.775,52.164,4.285],[19.175,52.164,5.905],[24.575,52.164,4.284],[24.575,52.164,3.85]],[[13.775,87.114,3.85],[13.775,87.114,4.285],[19.175,87.114,5.905],[24.575,87.114,4.284],[24.575,87.114,3.85]]],"aberturas_techo":[],"celosias":[]},{"cod":"E-05","nombre":"SUM","npt":0.15,"piso":[44.095,56.688,60.795,88.389],"muros":[[45.935,57.954,52.105,57.954,0.13,0.15,3.85,true],[52.785,57.954,58.955,57.954,0.13,0.15,3.85,true],[55.965,61.039,59.595,61.039,0.13,0.15,3.85,false],[45.935,63.754,52.145,63.754,0.13,0.15,5.05,false],[55.965,63.754,58.955,63.754,0.13,0.15,5.05,false],[45.935,81.154,52.105,81.154,0.13,0.15,5.05,false],[52.785,81.154,58.955,81.154,0.13,0.15,5.05,false],[45.935,87.124,52.105,87.124,0.13,0.15,3.85,true],[52.785,87.124,58.955,87.124,0.13,0.15,3.85,true],[45.36,58.528,45.36,63.689,0.13,0.15,3.85,true],[45.36,64.329,45.36,69.339,0.13,0.15,5.05,true],[45.36,69.994,45.36,75.099,0.13,0.15,5.05,true],[45.36,75.779,45.36,79.559,0.13,0.15,5.05,true],[45.36,81.389,45.36,86.549,0.13,0.15,3.85,true],[50.04,57.889,50.04,63.689,0.13,0.15,3.85,false],[52.53,81.429,52.53,86.849,0.13,0.15,3.85,false],[56.03,57.889,56.03,63.75,0.13,0.15,3.85,false],[56.03,63.75,56.03,63.819,0.13,0.15,5.05,false],[59.53,58.529,59.53,63.649,0.13,0.15,3.85,true],[59.53,64.329,59.53,69.299,0.13,0.15,5.05,true],[59.53,69.979,59.53,75.099,0.13,0.15,5.05,true],[59.53,75.779,59.53,80.749,0.13,0.15,5.05,true],[59.53,81.389,59.53,86.549,0.13,0.15,3.85,true]],"vigas":[[45.935,57.954,52.105,57.954,0.15,3.44,3.85],[52.785,57.954,58.955,57.954,0.15,3.44,3.85],[55.965,61.039,59.595,61.039,0.15,3.44,3.85],[45.935,63.754,52.145,63.754,0.15,4.64,5.05],[55.965,63.754,58.955,63.754,0.15,4.64,5.05],[45.935,81.154,52.105,81.154,0.15,4.64,5.05],[52.785,81.154,58.955,81.154,0.15,4.64,5.05],[45.935,87.124,52.105,87.124,0.15,3.44,3.85],[52.785,87.124,58.955,87.124,0.15,3.44,3.85],[45.36,58.528,45.36,63.689,0.15,3.44,3.85],[45.36,64.329,45.36,69.339,0.15,4.64,5.05],[45.36,69.994,45.36,75.099,0.15,4.64,5.05],[45.36,75.779,45.36,79.559,0.15,4.64,5.05],[45.36,81.389,45.36,86.549,0.15,3.44,3.85],[50.04,57.889,50.04,63.689,0.15,3.44,3.85],[52.53,81.429,52.53,86.849,0.15,3.44,3.85],[56.03,57.889,56.03,63.75,0.15,3.44,3.85],[56.03,63.75,56.03,63.819,0.15,4.64,5.05],[59.53,58.529,59.53,63.649,0.15,3.44,3.85],[59.53,64.329,59.53,69.299,0.15,4.64,5.05],[59.53,69.979,59.53,75.099,0.15,4.64,5.05],[59.53,75.779,59.53,80.749,0.15,4.64,5.05],[59.53,81.389,59.53,86.549,0.15,3.44,3.85]],"columnas":[[45.595,58.188,0.6,0.6,0.15,3.85],[45.595,63.989,0.6,0.6,0.15,5.05],[45.545,69.639,0.5,0.6,0.15,5.05],[45.545,75.439,0.5,0.6,0.15,5.05],[45.595,81.089,0.6,0.6,0.15,5.05],[45.595,86.889,0.6,0.6,0.15,3.85],[52.445,58.039,0.6,0.3,0.15,3.85],[52.445,63.839,0.6,0.3,0.15,5.05],[52.445,81.239,0.6,0.3,0.15,5.05],[52.445,87.039,0.6,0.3,0.15,3.85],[59.295,58.189,0.6,0.6,0.15,3.85],[59.295,63.989,0.6,0.6,0.15,5.05],[59.345,69.639,0.5,0.6,0.15,5.05],[59.345,75.439,0.5,0.6,0.15,5.05],[59.295,81.089,0.6,0.6,0.15,5.05],[59.295,86.889,0.6,0.6,0.15,3.85]],"puertas":[{"cod":"P-10","x":56.03,"y":61.611,"o":"V","ancho":0.995,"alto":2.5,"sill":0.15,"sobreluz":0.0,"vidrio":false,"via":"vano","muro":16},{"cod":"P-10","x":51.63,"y":63.754,"o":"H","ancho":1.0,"alto":2.5,"sill":0.15,"sobreluz":0.0,"vidrio":false,"via":"vano","muro":3},{"cod":"P-1","x":59.53,"y":82.004,"o":"V","ancho":1.2,"alto":2.5,"sill":0.15,"sobreluz":0.785,"vidrio":false,"via":"vano","muro":22},{"cod":"P-4","x":56.03,"y":60.509,"o":"V","ancho":0.9,"alto":2.5,"sill":0.15,"sobreluz":0.785,"vidrio":false,"via":"vano","muro":16},{"cod":"P-4","x":56.56,"y":57.954,"o":"H","ancho":0.9,"alto":2.5,"sill":0.15,"sobreluz":0.785,"vidrio":false,"via":"vano","muro":1},{"cod":"P-4","x":55.5,"y":57.954,"o":"H","ancho":0.9,"alto":2.5,"sill":0.15,"sobreluz":0.785,"vidrio":false,"via":"vano","muro":1},{"cod":"P-1","x":45.36,"y":63.074,"o":"V","ancho":1.2,"alto":2.5,"sill":0.15,"sobreluz":0.785,"vidrio":false,"via":"vano","muro":9},{"cod":"P-1","x":45.36,"y":82.004,"o":"V","ancho":1.2,"alto":2.5,"sill":0.15,"sobreluz":0.785,"vidrio":false,"via":"vano","muro":13},{"cod":"P-1","x":45.36,"y":68.724,"o":"V","ancho":1.2,"alto":2.5,"sill":0.15,"sobreluz":0.785,"vidrio":false,"via":"vano","muro":10},{"cod":"P-1","x":45.36,"y":76.399,"o":"V","ancho":1.2,"alto":2.5,"sill":0.15,"sobreluz":0.0,"vidrio":false,"via":"proyeccion","muro":12}],"ventanas":[{"cod":"V-34","x":45.36,"y":60.493,"o":"V","ancho":3.371,"alto":0.79,"sill":2.65,"via":"vano","muro":9},{"cod":"V-34","x":45.36,"y":84.584,"o":"V","ancho":3.371,"alto":0.79,"sill":2.65,"via":"vano","muro":13},{"cod":"V-50","x":57.99,"y":57.954,"o":"H","ancho":1.37,"alto":1.99,"sill":1.45,"via":"vano","muro":1},{"cod":"V-49","x":50.98,"y":57.954,"o":"H","ancho":1.69,"alto":1.99,"sill":1.45,"via":"vano","muro":0},{"cod":"V-49","x":53.91,"y":57.954,"o":"H","ancho":1.69,"alto":1.99,"sill":1.45,"via":"vano","muro":1},{"cod":"V-40","x":55.865,"y":87.124,"o":"H","ancho":5.6,"alto":1.99,"sill":1.45,"via":"vano","muro":8},{"cod":"V-48","x":59.53,"y":59.876,"o":"V","ancho":2.136,"alto":0.79,"sill":2.65,"via":"vano","muro":18},{"cod":"V-43","x":59.53,"y":78.263,"o":"V","ancho":4.411,"alto":0.79,"sill":2.65,"via":"vano","muro":21},{"cod":"V-41","x":59.53,"y":72.538,"o":"V","ancho":4.561,"alto":0.79,"sill":2.65,"via":"vano","muro":20},{"cod":"V-44","x":48.08,"y":57.954,"o":"H","ancho":3.73,"alto":1.99,"sill":1.45,"via":"vano","muro":0},{"cod":"V-47","x":59.53,"y":62.251,"o":"V","ancho":2.236,"alto":0.79,"sill":2.65,"via":"vano","muro":18},{"cod":"V-43","x":59.53,"y":66.814,"o":"V","ancho":4.411,"alto":0.79,"sill":2.65,"via":"vano","muro":19},{"cod":"V-42","x":45.36,"y":72.547,"o":"V","ancho":4.545,"alto":1.99,"sill":1.45,"via":"vano","muro":11},{"cod":"V-55","x":45.36,"y":66.219,"o":"V","ancho":3.17,"alto":0.79,"sill":2.65,"via":"vano","muro":10},{"cod":"V-45","x":59.53,"y":84.584,"o":"V","ancho":3.37,"alto":1.99,"sill":1.45,"via":"vano","muro":22},{"cod":"V-46","x":45.36,"y":77.669,"o":"V","ancho":3.22,"alto":0.79,"sill":2.65,"via":"vano","muro":12},{"cod":"V-40","x":49.265,"y":87.124,"o":"H","ancho":5.64,"alto":1.99,"sill":1.45,"via":"proyeccion","muro":7}],"techos":[{"rect":[43.78,56.374,61.11,63.75],"base":3.85,"pend":0.3,"eje":"y"},{"rect":[43.78,63.45,61.11,81.45],"base":5.05,"pend":0.3,"eje":"y"},{"rect":[43.78,81.15,61.11,88.704],"base":3.85,"pend":0.3,"eje":"y"}],"hastiales":[[[45.295,57.963,3.85],[45.295,57.963,4.285],[52.445,57.963,6.429],[59.595,57.963,4.285],[59.595,57.963,3.85]],[[45.295,63.75,5.05],[45.295,63.75,5.485],[52.445,63.75,7.63],[59.595,63.75,5.485],[59.595,63.75,5.05]],[[45.295,81.15,5.05],[45.295,81.15,5.485],[52.445,81.15,7.63],[59.595,81.15,5.485],[59.595,81.15,5.05]],[[45.295,87.114,3.85],[45.295,87.114,4.285],[52.445,87.114,6.429],[59.595,87.114,4.285],[59.595,87.114,3.85]]],"aberturas_techo":[],"celosias":[]},{"cod":"E-06","nombre":"","npt":0.15,"piso":[30.87,91.509,50.97,104.709],"muros":[[32.71,92.774,49.13,92.774,0.13,0.15,3.85,true],[38.21,96.274,40.48,96.274,0.13,0.15,3.85,false],[32.32,96.444,35.04,96.444,0.13,0.15,3.85,false],[46.8,96.444,49.52,96.444,0.13,0.15,3.85,false],[34.91,98.109,38.17,98.109,0.13,0.15,3.85,false],[43.67,98.109,46.93,98.109,0.13,0.15,3.85,false],[32.32,99.774,35.04,99.774,0.13,0.15,3.85,false],[38.21,99.774,43.63,99.774,0.13,0.15,3.85,false],[46.8,99.774,49.52,99.774,0.13,0.15,3.85,false],[38.21,101.529,40.16,101.529,0.13,0.15,3.85,false],[32.71,103.444,49.13,103.444,0.13,0.15,3.85,true],[32.135,93.349,32.135,96.069,0.13,0.15,3.85,true],[32.135,100.149,32.135,102.869,0.13,0.15,3.85,true],[33.315,96.509,33.315,99.839,0.13,0.15,3.85,false],[34.975,96.509,34.975,99.709,0.13,0.15,3.85,false],[38.105,92.999,38.105,103.219,0.13,0.15,3.85,false],[40.225,101.464,40.225,103.509,0.13,0.15,3.85,false],[40.415,92.709,40.415,96.209,0.13,0.15,3.85,false],[43.735,92.999,43.735,95.769,0.13,0.15,3.85,false],[43.735,96.549,43.735,103.219,0.13,0.15,3.85,false],[46.865,96.509,46.865,99.709,0.13,0.15,3.85,false],[48.525,96.509,48.525,99.839,0.13,0.15,3.85,false],[49.705,93.349,49.705,96.069,0.13,0.15,3.85,true],[49.705,100.149,49.705,102.869,0.13,0.15,3.85,true]],"vigas":[[32.71,92.774,49.13,92.774,0.15,3.44,3.85],[38.21,96.274,40.48,96.274,0.15,3.44,3.85],[32.32,96.444,35.04,96.444,0.15,3.44,3.85],[46.8,96.444,49.52,96.444,0.15,3.44,3.85],[34.91,98.109,38.17,98.109,0.15,3.44,3.85],[43.67,98.109,46.93,98.109,0.15,3.44,3.85],[32.32,99.774,35.04,99.774,0.15,3.44,3.85],[38.21,99.774,43.63,99.774,0.15,3.44,3.85],[46.8,99.774,49.52,99.774,0.15,3.44,3.85],[38.21,101.529,40.16,101.529,0.15,3.44,3.85],[32.71,103.444,49.13,103.444,0.15,3.44,3.85],[32.135,93.349,32.135,96.069,0.15,3.44,3.85],[32.135,100.149,32.135,102.869,0.15,3.44,3.85],[33.315,96.509,33.315,99.839,0.15,3.44,3.85],[34.975,96.509,34.975,99.709,0.15,3.44,3.85],[38.105,92.999,38.105,103.219,0.15,3.44,3.85],[40.225,101.464,40.225,103.509,0.15,3.44,3.85],[40.415,92.709,40.415,96.209,0.15,3.44,3.85],[43.735,92.999,43.735,95.769,0.15,3.44,3.85],[43.735,96.549,43.735,103.219,0.15,3.44,3.85],[46.865,96.509,46.865,99.709,0.15,3.44,3.85],[48.525,96.509,48.525,99.839,0.15,3.44,3.85],[49.705,93.349,49.705,96.069,0.15,3.44,3.85],[49.705,100.149,49.705,102.869,0.15,3.44,3.85]],"columnas":[[32.37,93.009,0.6,0.6,0.15,3.85],[37.97,92.834,0.4,0.25,0.15,3.85],[32.195,96.309,0.25,0.4,0.15,3.85],[38.045,96.309,0.25,0.4,0.15,3.85],[32.195,99.909,0.25,0.4,0.15,3.85],[38.045,99.909,0.25,0.4,0.15,3.85],[32.37,103.209,0.6,0.6,0.15,3.85],[37.97,103.384,0.4,0.25,0.15,3.85],[43.87,92.834,0.4,0.25,0.15,3.85],[43.795,96.309,0.25,0.4,0.15,3.85],[43.795,99.909,0.25,0.4,0.15,3.85],[43.87,103.384,0.4,0.25,0.15,3.85],[49.47,93.009,0.6,0.6,0.15,3.85],[49.645,96.309,0.25,0.4,0.15,3.85],[49.645,99.909,0.25,0.4,0.15,3.85],[49.47,103.209,0.6,0.6,0.15,3.85]],"puertas":[{"cod":"P-4","x":49.055,"y":96.444,"o":"H","ancho":0.9,"alto":2.5,"sill":0.15,"sobreluz":0.785,"vidrio":false,"via":"vano","muro":3},{"cod":"P-4","x":32.785,"y":96.444,"o":"H","ancho":0.9,"alto":2.5,"sill":0.15,"sobreluz":0.785,"vidrio":false,"via":"vano","muro":2},{"cod":"P-4","x":40.755,"y":103.444,"o":"H","ancho":0.9,"alto":2.5,"sill":0.15,"sobreluz":0.785,"vidrio":false,"via":"vano","muro":10},{"cod":"P-6","x":33.315,"y":96.924,"o":"V","ancho":0.8,"alto":2.5,"sill":0.15,"sobreluz":0.785,"vidrio":false,"via":"vano","muro":13},{"cod":"P-6","x":48.525,"y":96.924,"o":"V","ancho":0.8,"alto":2.5,"sill":0.15,"sobreluz":0.785,"vidrio":false,"via":"vano","muro":21},{"cod":"P-7","x":39.745,"y":101.529,"o":"H","ancho":0.8,"alto":2.5,"sill":0.15,"sobreluz":0.0,"vidrio":false,"via":"vano","muro":9},{"cod":"P-4","x":32.785,"y":99.774,"o":"H","ancho":0.9,"alto":2.5,"sill":0.15,"sobreluz":0.785,"vidrio":false,"via":"vano","muro":6},{"cod":"P-2","x":43.155,"y":92.774,"o":"H","ancho":1.0,"alto":2.5,"sill":0.15,"sobreluz":0.785,"vidrio":false,"via":"vano","muro":0},{"cod":"P-3","x":40.415,"y":95.694,"o":"V","ancho":1.0,"alto":2.5,"sill":0.15,"sobreluz":0.0,"vidrio":false,"via":"vano","muro":17},{"cod":"P-4","x":48.99,"y":99.774,"o":"H","ancho":0.9,"alto":2.5,"sill":0.15,"sobreluz":0.785,"vidrio":false,"via":"vano","muro":8}],"ventanas":[{"cod":"V-54","x":32.135,"y":94.709,"o":"V","ancho":2.16,"alto":0.79,"sill":2.65,"via":"vano","muro":11},{"cod":"V-58","x":33.315,"y":98.149,"o":"V","ancho":1.06,"alto":0.79,"sill":2.65,"via":"vano","muro":13},{"cod":"V-54","x":32.135,"y":101.509,"o":"V","ancho":2.16,"alto":0.79,"sill":2.65,"via":"vano","muro":12},{"cod":"V-57","x":39.249,"y":103.444,"o":"H","ancho":1.521,"alto":0.79,"sill":2.65,"via":"vano","muro":10},{"cod":"V-54","x":49.705,"y":94.709,"o":"V","ancho":2.16,"alto":0.79,"sill":2.65,"via":"vano","muro":22},{"cod":"V-53","x":47.365,"y":92.774,"o":"H","ancho":2.97,"alto":1.99,"sill":1.45,"via":"vano","muro":0},{"cod":"V-53","x":47.365,"y":103.444,"o":"H","ancho":2.97,"alto":1.99,"sill":1.45,"via":"vano","muro":10},{"cod":"V-53","x":34.475,"y":103.444,"o":"H","ancho":2.97,"alto":1.99,"sill":1.45,"via":"vano","muro":10},{"cod":"V-58","x":48.525,"y":98.149,"o":"V","ancho":1.06,"alto":0.79,"sill":2.65,"via":"vano","muro":21},{"cod":"V-53","x":34.475,"y":92.774,"o":"H","ancho":2.97,"alto":1.99,"sill":1.45,"via":"vano","muro":0},{"cod":"V-55","x":41.435,"y":92.774,"o":"H","ancho":1.85,"alto":1.99,"sill":1.45,"via":"vano","muro":0},{"cod":"V-54","x":49.705,"y":101.509,"o":"V","ancho":2.16,"alto":0.79,"sill":2.65,"via":"vano","muro":23},{"cod":"V-3","x":42.425,"y":103.444,"o":"H","ancho":1.8,"alto":0.79,"sill":2.65,"via":"vano","muro":10},{"cod":"V-56","x":39.426,"y":92.774,"o":"H","ancho":1.74,"alto":0.79,"sill":2.65,"via":"proyeccion","muro":0}],"techos":[{"rect":[30.555,91.194,51.285,105.024],"base":3.85,"pend":0.3,"eje":"x"}],"hastiales":[[[32.145,92.709,3.85],[32.145,92.709,4.285],[32.145,98.109,5.904],[32.145,103.509,4.285],[32.145,103.509,3.85]],[[49.695,92.709,3.85],[49.695,92.709,4.285],[49.695,98.109,5.904],[49.695,103.509,4.285],[49.695,103.509,3.85]]],"aberturas_techo":[],"celosias":[]},{"cod":"E-08","nombre":"","npt":0.15,"piso":[30.87,115.809,50.97,129.009],"muros":[[32.71,117.074,49.13,117.074,0.13,0.15,3.85,true],[38.21,118.134,40.0,118.134,0.13,0.15,3.85,false],[38.21,119.514,40.0,119.514,0.13,0.15,3.85,false],[38.21,120.574,40.13,120.574,0.13,0.15,3.85,false],[32.32,120.744,35.04,120.744,0.13,0.15,3.85,false],[46.8,120.744,49.52,120.744,0.13,0.15,3.85,false],[34.91,122.409,38.17,122.409,0.13,0.15,3.85,false],[43.67,122.409,46.93,122.409,0.13,0.15,3.85,false],[32.32,124.074,35.04,124.074,0.13,0.15,3.85,false],[38.21,124.074,43.63,124.074,0.13,0.15,3.85,false],[46.8,124.074,49.52,124.074,0.13,0.15,3.85,false],[38.21,125.829,40.16,125.829,0.13,0.15,3.85,false],[32.71,127.744,49.13,127.744,0.13,0.15,3.85,true],[32.135,117.649,32.135,120.369,0.13,0.15,3.85,true],[32.135,124.449,32.135,127.169,0.13,0.15,3.85,true],[33.315,120.809,33.315,124.139,0.13,0.15,3.85,false],[34.975,120.809,34.975,124.009,0.13,0.15,3.85,false],[38.105,117.299,38.105,127.519,0.13,0.15,3.85,false],[40.065,117.009,40.065,118.199,0.13,0.15,3.85,false],[40.065,119.449,40.065,120.639,0.13,0.15,3.85,false],[40.225,125.764,40.225,127.809,0.13,0.15,3.85,false],[43.735,117.299,43.735,120.069,0.13,0.15,3.85,false],[43.735,120.849,43.735,127.519,0.13,0.15,3.85,false],[46.865,120.809,46.865,124.009,0.13,0.15,3.85,false],[48.525,120.809,48.525,124.139,0.13,0.15,3.85,false],[49.705,117.649,49.705,120.369,0.13,0.15,3.85,true],[49.705,124.449,49.705,127.169,0.13,0.15,3.85,true]],"vigas":[[32.71,117.074,49.13,117.074,0.15,3.44,3.85],[38.21,118.134,40.0,118.134,0.15,3.44,3.85],[38.21,119.514,40.0,119.514,0.15,3.44,3.85],[38.21,120.574,40.13,120.574,0.15,3.44,3.85],[32.32,120.744,35.04,120.744,0.15,3.44,3.85],[46.8,120.744,49.52,120.744,0.15,3.44,3.85],[34.91,122.409,38.17,122.409,0.15,3.44,3.85],[43.67,122.409,46.93,122.409,0.15,3.44,3.85],[32.32,124.074,35.04,124.074,0.15,3.44,3.85],[38.21,124.074,43.63,124.074,0.15,3.44,3.85],[46.8,124.074,49.52,124.074,0.15,3.44,3.85],[38.21,125.829,40.16,125.829,0.15,3.44,3.85],[32.71,127.744,49.13,127.744,0.15,3.44,3.85],[32.135,117.649,32.135,120.369,0.15,3.44,3.85],[32.135,124.449,32.135,127.169,0.15,3.44,3.85],[33.315,120.809,33.315,124.139,0.15,3.44,3.85],[34.975,120.809,34.975,124.009,0.15,3.44,3.85],[38.105,117.299,38.105,127.519,0.15,3.44,3.85],[40.065,117.009,40.065,118.199,0.15,3.44,3.85],[40.065,119.449,40.065,120.639,0.15,3.44,3.85],[40.225,125.764,40.225,127.809,0.15,3.44,3.85],[43.735,117.299,43.735,120.069,0.15,3.44,3.85],[43.735,120.849,43.735,127.519,0.15,3.44,3.85],[46.865,120.809,46.865,124.009,0.15,3.44,3.85],[48.525,120.809,48.525,124.139,0.15,3.44,3.85],[49.705,117.649,49.705,120.369,0.15,3.44,3.85],[49.705,124.449,49.705,127.169,0.15,3.44,3.85]],"columnas":[[32.37,117.309,0.6,0.6,0.15,3.85],[37.97,117.134,0.4,0.25,0.15,3.85],[32.195,120.609,0.25,0.4,0.15,3.85],[38.045,120.609,0.25,0.4,0.15,3.85],[32.195,124.209,0.25,0.4,0.15,3.85],[38.045,124.209,0.25,0.4,0.15,3.85],[32.37,127.509,0.6,0.6,0.15,3.85],[37.97,127.684,0.4,0.25,0.15,3.85],[43.87,117.134,0.4,0.25,0.15,3.85],[43.795,120.609,0.25,0.4,0.15,3.85],[43.795,124.209,0.25,0.4,0.15,3.85],[43.87,127.684,0.4,0.25,0.15,3.85],[49.47,117.309,0.6,0.6,0.15,3.85],[49.645,120.609,0.25,0.4,0.15,3.85],[49.645,124.209,0.25,0.4,0.15,3.85],[49.47,127.509,0.6,0.6,0.15,3.85]],"puertas":[{"cod":"P-4","x":49.055,"y":120.744,"o":"H","ancho":0.9,"alto":2.5,"sill":0.15,"sobreluz":0.785,"vidrio":false,"via":"vano","muro":5},{"cod":"P-4","x":32.785,"y":120.744,"o":"H","ancho":0.9,"alto":2.5,"sill":0.15,"sobreluz":0.785,"vidrio":false,"via":"vano","muro":4},{"cod":"P-4","x":40.755,"y":127.744,"o":"H","ancho":0.9,"alto":2.5,"sill":0.15,"sobreluz":0.785,"vidrio":false,"via":"vano","muro":12},{"cod":"P-6","x":33.315,"y":121.224,"o":"V","ancho":0.8,"alto":2.5,"sill":0.15,"sobreluz":0.785,"vidrio":false,"via":"vano","muro":15},{"cod":"P-6","x":48.525,"y":121.224,"o":"V","ancho":0.8,"alto":2.5,"sill":0.15,"sobreluz":0.785,"vidrio":false,"via":"vano","muro":24},{"cod":"P-7","x":39.585,"y":118.134,"o":"H","ancho":0.8,"alto":2.5,"sill":0.15,"sobreluz":0.0,"vidrio":false,"via":"vano","muro":1},{"cod":"P-7","x":39.745,"y":125.829,"o":"H","ancho":0.8,"alto":2.5,"sill":0.15,"sobreluz":0.0,"vidrio":false,"via":"vano","muro":11},{"cod":"P-7","x":39.585,"y":119.514,"o":"H","ancho":0.8,"alto":2.5,"sill":0.15,"sobreluz":0.0,"vidrio":false,"via":"vano","muro":2},{"cod":"P-4","x":32.785,"y":124.074,"o":"H","ancho":0.9,"alto":2.5,"sill":0.15,"sobreluz":0.785,"vidrio":false,"via":"vano","muro":8},{"cod":"P-4","x":40.595,"y":117.074,"o":"H","ancho":0.9,"alto":2.5,"sill":0.15,"sobreluz":0.785,"vidrio":false,"via":"vano","muro":0},{"cod":"P-4","x":48.99,"y":124.074,"o":"H","ancho":0.9,"alto":2.5,"sill":0.15,"sobreluz":0.785,"vidrio":false,"via":"vano","muro":10}],"ventanas":[{"cod":"V-58","x":33.315,"y":122.449,"o":"V","ancho":1.06,"alto":0.79,"sill":2.65,"via":"vano","muro":15},{"cod":"V-54","x":32.135,"y":119.009,"o":"V","ancho":2.16,"alto":0.79,"sill":2.65,"via":"vano","muro":13},{"cod":"V-54","x":32.135,"y":125.809,"o":"V","ancho":2.16,"alto":0.79,"sill":2.65,"via":"vano","muro":14},{"cod":"V-55","x":42.425,"y":127.744,"o":"H","ancho":1.85,"alto":1.99,"sill":1.45,"via":"vano","muro":12},{"cod":"V-57","x":39.249,"y":127.744,"o":"H","ancho":1.521,"alto":0.79,"sill":2.65,"via":"vano","muro":12},{"cod":"V-54","x":49.705,"y":119.009,"o":"V","ancho":2.16,"alto":0.79,"sill":2.65,"via":"vano","muro":25},{"cod":"V-62","x":42.345,"y":117.074,"o":"H","ancho":2.01,"alto":1.99,"sill":1.45,"via":"vano","muro":0},{"cod":"V-53","x":47.365,"y":117.074,"o":"H","ancho":2.97,"alto":1.99,"sill":1.45,"via":"vano","muro":0},{"cod":"V-53","x":47.365,"y":127.744,"o":"H","ancho":2.97,"alto":1.99,"sill":1.45,"via":"vano","muro":12},{"cod":"V-70","x":39.169,"y":117.074,"o":"H","ancho":1.361,"alto":0.79,"sill":2.65,"via":"vano","muro":0},{"cod":"V-53","x":34.475,"y":127.744,"o":"H","ancho":2.97,"alto":1.99,"sill":1.45,"via":"vano","muro":12},{"cod":"V-58","x":48.525,"y":122.449,"o":"V","ancho":1.06,"alto":0.79,"sill":2.65,"via":"vano","muro":24},{"cod":"V-53","x":34.475,"y":117.074,"o":"H","ancho":2.97,"alto":1.99,"sill":1.45,"via":"vano","muro":0},{"cod":"V-54","x":49.705,"y":125.809,"o":"V","ancho":2.16,"alto":0.79,"sill":2.65,"via":"vano","muro":26}],"techos":[{"rect":[30.555,115.494,51.285,129.324],"base":3.85,"pend":0.3,"eje":"x"}],"hastiales":[[[32.145,117.009,3.85],[32.145,117.009,4.285],[32.145,122.409,5.905],[32.145,127.809,4.285],[32.145,127.809,3.85]],[[49.695,117.009,3.85],[49.695,117.009,4.285],[49.695,122.409,5.905],[49.695,127.809,4.285],[49.695,127.809,3.85]]],"aberturas_techo":[],"celosias":[]},{"cod":"E-07","nombre":"","npt":0.15,"piso":[54.5,91.509,67.7,129.009],"muros":[[56.34,92.774,65.86,92.774,0.13,0.15,3.85,true],[55.7,96.384,57.745,96.384,0.13,0.15,3.85,false],[62.87,96.614,64.06,96.614,0.13,0.15,3.85,false],[65.31,96.614,66.5,96.614,0.13,0.15,3.85,false],[55.99,98.574,66.21,98.574,0.13,0.15,3.85,false],[62.87,100.554,64.06,100.554,0.13,0.15,3.85,false],[65.31,100.554,66.5,100.554,0.13,0.15,3.85,false],[55.7,100.714,57.745,100.714,0.13,0.15,3.85,false],[55.99,104.374,66.21,104.374,0.13,0.15,3.85,false],[64.455,108.044,66.5,108.044,0.13,0.15,3.85,false],[55.7,108.214,56.89,108.214,0.13,0.15,3.85,false],[58.14,108.214,59.33,108.214,0.13,0.15,3.85,false],[55.99,110.174,66.21,110.174,0.13,0.15,3.85,false],[55.7,112.154,56.89,112.154,0.13,0.15,3.85,false],[58.14,112.154,59.33,112.154,0.13,0.15,3.85,false],[64.455,112.314,66.5,112.314,0.13,0.15,3.85,false],[55.99,115.974,66.21,115.974,0.13,0.15,3.85,false],[64.455,119.804,66.5,119.804,0.13,0.15,3.85,false],[55.7,119.964,56.89,119.964,0.13,0.15,3.85,false],[58.14,119.964,59.33,119.964,0.13,0.15,3.85,false],[55.99,121.944,66.21,121.944,0.13,0.15,3.85,false],[59.37,124.904,62.83,124.904,0.13,0.15,3.85,false],[59.5,126.564,62.83,126.564,0.13,0.15,3.85,false],[56.34,127.744,59.06,127.744,0.13,0.15,3.85,true],[63.14,127.744,65.86,127.744,0.13,0.15,3.85,true],[55.765,93.349,55.765,127.169,0.13,0.15,3.85,true],[56.825,108.279,56.825,110.069,0.13,0.15,3.85,false],[56.825,110.279,56.825,112.089,0.13,0.15,3.85,false],[56.825,120.029,56.825,122.009,0.13,0.15,3.85,false],[57.68,96.319,57.68,98.509,0.13,0.15,3.85,false],[57.68,98.639,57.68,100.779,0.13,0.15,3.85,false],[58.205,108.279,58.205,110.069,0.13,0.15,3.85,false],[58.205,110.279,58.205,112.089,0.13,0.15,3.85,false],[58.205,120.029,58.205,122.009,0.13,0.15,3.85,false],[59.265,108.149,59.265,110.069,0.13,0.15,3.85,false],[59.265,110.399,59.265,112.219,0.13,0.15,3.85,false],[59.265,119.899,59.265,121.719,0.13,0.15,3.85,false],[59.435,92.999,59.435,98.469,0.13,0.15,3.85,false],[59.435,98.799,59.435,104.269,0.13,0.15,3.85,false],[59.435,124.839,59.435,127.559,0.13,0.15,3.85,false],[61.1,121.879,61.1,124.969,0.13,0.15,3.85,false],[62.765,104.599,62.765,110.069,0.13,0.15,3.85,false],[62.765,110.399,62.765,115.869,0.13,0.15,3.85,false],[62.765,116.199,62.765,121.719,0.13,0.15,3.85,false],[62.765,124.839,62.765,127.559,0.13,0.15,3.85,false],[62.935,96.55,62.935,98.469,0.13,0.15,3.85,false],[62.935,98.799,62.935,100.619,0.13,0.15,3.85,false],[63.995,96.679,63.995,98.469,0.13,0.15,3.85,false],[63.995,98.679,63.995,100.489,0.13,0.15,3.85,false],[64.52,108.109,64.52,110.069,0.13,0.15,3.85,false],[64.52,110.279,64.52,112.249,0.13,0.15,3.85,false],[64.52,119.869,64.52,122.009,0.13,0.15,3.85,false],[65.375,96.679,65.375,98.469,0.13,0.15,3.85,false],[65.375,98.679,65.375,100.489,0.13,0.15,3.85,false],[66.435,93.349,66.435,127.169,0.13,0.15,3.85,true]],"vigas":[[56.34,92.774,65.86,92.774,0.15,3.44,3.85],[55.7,96.384,57.745,96.384,0.15,3.44,3.85],[62.87,96.614,64.06,96.614,0.15,3.44,
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"columnas":[[56.0,93.009,0.6,0.6,0.15,3.85],[55.825,98.559,0.25,0.4,0.15,3.85],[55.825,104.359,0.25,0.4,0.15,3.85],[55.825,110.309,0.25,0.4,0.15,3.85],[55.825,116.109,0.25,0.4,0.15,3.85],[55.825,121.809,0.25,0.4,0.15,3.85],[56.0,127.509,0.6,0.6,0.15,3.85],[59.3,92.834,0.4,0.25,0.15,3.85],[59.3,98.634,0.4,0.25,0.15,3.85],[59.3,104.434,0.4,0.25,0.15,3.85],[59.3,110.234,0.4,0.25,0.15,3.85],[59.3,116.034,0.4,0.25,0.15,3.85],[59.3,121.884,0.4,0.25,0.15,3.85],[59.3,127.684,0.4,0.25,0.15,3.85],[62.9,92.834,0.4,0.25,0.15,3.85],[66.2,93.009,0.6,0.6,0.15,3.85],[62.9,98.634,0.4,0.25,0.15,3.85],[62.9,104.434,0.4,0.25,0.15,3.85],[62.9,110.234,0.4,0.25,0.15,3.85],[62.9,116.034,0.4,0.25,0.15,3.85],[62.9,121.884,0.4,0.25,0.15,3.85],[62.9,127.684,0.4,0.25,0.15,3.85],[66.2,127.509,0.6,0.6,0.15,3.85],[66.375,98.559,0.25,0.4,0.15,3.85],[66.375,104.359,0.25,0.4,0.15,3.85],[66.375,110.309,0.25,0.4,0.15,3.85],[66.375,116.109,0.25,0.4,0.15,3.85],[66.375,121.809,0.25,0.4,0.15,3.85]],"puertas":[{"cod":"P-7","x":64.52,"y":120.284,"o":"V","ancho":0.8,"alto":2.5,"sill":0.15,"sobreluz":0.0,"vidrio":false,"via":"vano","muro":51},{"cod":"P-7","x":64.52,"y":108.524,"o":"V","ancho":0.8,"alto":2.5,"sill":0.15,"sobreluz":0.0,"vidrio":false,"via":"vano","muro":49},{"cod":"P-7","x":56.825,"y":120.444,"o":"V","ancho":0.8,"alto":2.5,"sill":0.15,"sobreluz":0.0,"vidrio":false,"via":"vano","muro":28},{"cod":"P-7","x":63.995,"y":97.094,"o":"V","ancho":0.8,"alto":2.5,"sill":0.15,"sobreluz":0.0,"vidrio":false,"via":"vano","muro":47},{"cod":"P-7","x":64.52,"y":111.834,"o":"V","ancho":0.8,"alto":2.5,"sill":0.15,"sobreluz":0.0,"vidrio":false,"via":"vano","muro":50},{"cod":"P-7","x":57.68,"y":99.054,"o":"V","ancho":0.8,"alto":2.5,"sill":0.15,"sobreluz":0.0,"vidrio":false,"via":"vano","muro":30},{"cod":"P-7","x":58.205,"y":111.674,"o":"V","ancho":0.8,"alto":2.5,"sill":0.15,"sobreluz":0.0,"vidrio":false,"via":"vano","muro":32},{"cod":"P-7","x":56.825,"y":108.694,"o":"V","ancho":0.8,"alto":2.5,"sill":0.15,"sobreluz":0.0,"vidrio":false,"via":"vano","muro":26},{"cod":"P-7","x":57.68,"y":98.094,"o":"V","ancho":0.8,"alto":2.5,"sill":0.15,"sobreluz":0.0,"vidrio":false,"via":"vano","muro":29},{"cod":"P-7","x":65.375,"y":97.094,"o":"V","ancho":0.8,"alto":2.5,"sill":0.15,"sobreluz":0.0,"vidrio":false,"via":"vano","muro":52},{"cod":"P-4","x":55.765,"y":95.854,"o":"V","ancho":0.9,"alto":2.5,"sill":0.15,"sobreluz":0.785,"vidrio":false,"via":"vano","muro":25},{"cod":"P-4","x":66.435,"y":112.844,"o":"V","ancho":0.9,"alto":2.5,"sill":0.15,"sobreluz":0.785,"vidrio":false,"via":"vano","muro":54},{"cod":"P-4","x":66.435,"y":107.514,"o":"V","ancho":0.9,"alto":2.5,"sill":0.15,"sobreluz":0.785,"vidrio":false,"via":"vano","muro":54},{"cod":"P-7","x":65.375,"y":100.074,"o":"V","ancho":0.8,"alto":2.5,"sill":0.15,"sobreluz":0.0,"vidrio":false,"via":"vano","muro":53},{"cod":"P-4","x":66.435,"y":101.084,"o":"V","ancho":0.9,"alto":2.5,"sill":0.15,"sobreluz":0.785,"vidrio":false,"via":"vano","muro":54},{"cod":"P-4","x":66.435,"y":119.274,"o":"V","ancho":0.9,"alto":2.5,"sill":0.15,"sobreluz":0.785,"vidrio":false,"via":"vano","muro":54},{"cod":"P-4","x":66.435,"y":96.084,"o":"V","ancho":0.9,"alto":2.5,"sill":0.15,"sobreluz":0.785,"vidrio":false,"via":"vano","muro":54},{"cod":"P-4","x":55.765,"y":101.244,"o":"V","ancho":0.9,"alto":2.5,"sill":0.15,"sobreluz":0.785,"vidrio":false,"via":"vano","muro":25},{"cod":"P-4","x":55.765,"y":107.684,"o":"V","ancho":0.9,"alto":2.5,"sill":0.15,"sobreluz":0.785,"vidrio":false,"via":"vano","muro":25},{"cod":"P-6","x":59.915,"y":126.564,"o":"H","ancho":0.8,"alto":2.5,"sill":0.15,"sobreluz":0.785,"vidrio":false,"via":"vano","muro":22},{"cod":"P-7","x":58.205,"y":120.444,"o":"V","ancho":0.8,"alto":2.5,"sill":0.15,"sobreluz":0.0,"vidrio":false,"via":"vano","muro":33},{"cod":"P-4","x":55.765,"y":119.434,"o":"V","ancho":0.9,"alto":2.5,"sill":0.15,"sobreluz":0.785,"vidrio":false,"via":"vano","muro":25},{"cod":"P-4","x":55.765,"y":112.684,"o":"V","ancho":0.9,"alto":2.5,"sill":0.15,"sobreluz":0.785,"vidrio":false,"via":"vano","muro":25},{"cod":"P-7","x":58.205,"y":108.694,"o":"V","ancho":0.8,"alto":2.5,"sill":0.15,"sobreluz":0.0,"vidrio":false,"via":"vano","muro":31},{"cod":"P-4","x":62.765,"y":127.094,"o":"V","ancho":0.9,"alto":2.5,"sill":0.15,"sobreluz":0.785,"vidrio":false,"via":"vano","muro":44},{"cod":"P-7","x":56.825,"y":111.674,"o":"V","ancho":0.8,"alto":2.5,"sill":0.15,"sobreluz":0.0,"vidrio":false,"via":"vano","muro":27},{"cod":"P-7","x":63.995,"y":100.074,"o":"V","ancho":0.8,"alto":2.5,"sill":0.15,"sobreluz":0.0,"vidrio":false,"via":"vano","muro":48},{"cod":"P-4","x":59.435,"y":127.094,"o":"V","ancho":0.9,"alto":2.5,"sill":0.15,"sobreluz":0.785,"vidrio":false,"via":"vano","muro":39}],"ventanas":[{"cod":"V-53","x":55.765,"y":125.404,"o":"V","ancho":2.97,"alto":1.99,"sill":1.45,"via":"vano","muro":25},{"cod":"V-61","x":55.765,"y":105.909,"o":"V","ancho":2.06,"alto":1.99,"sill":1.45,"via":"vano","muro":25},{"cod":"V-65","x":55.765,"y":99.79,"o":"V","ancho":1.421,"alto":0.79,"sill":2.65,"via":"vano","muro":25},{"cod":"V-64","x":55.765,"y":102.914,"o":"V","ancho":1.85,"alto":1.99,"sill":1.45,"via":"vano","muro":25},{"cod":"V-66","x":55.765,"y":97.32,"o":"V","ancho":1.41,"alto":0.79,"sill":2.65,"via":"vano","muro":25},{"cod":"V-69","x":55.765,"y":120.734,"o":"V","ancho":1.11,"alto":0.79,"sill":2.65,"via":"vano","muro":25},{"cod":"V-58","x":61.139,"y":126.564,"o":"H","ancho":1.061,"alto":0.79,"sill":2.65,"via":"vano","muro":22},{"cod":"V-60","x":64.5,"y":127.744,"o":"H","ancho":2.16,"alto":1.99,"sill":1.45,"via":"vano","muro":24},{"cod":"V-57","x":66.435,"y":109.025,"o":"V","ancho":1.531,"alto":0.79,"sill":2.65,"via":"vano","muro":54},{"cod":"V-61","x":55.765,"y":117.659,"o":"V","ancho":2.06,"alto":1.99,"sill":1.45,"via":"vano","muro":25},{"cod":"V-60","x":57.7,"y":127.744,"o":"H","ancho":2.161,"alto":1.99,"sill":1.45,"via":"vano","muro":23},{"cod":"V-63","x":66.435,"y":117.579,"o":"V","ancho":1.9,"alto":1.99,"sill":1.45,"via":"vano","muro":54},{"cod":"V-53","x":66.435,"y":125.404,"o":"V","ancho":2.97,"alto":1.99,"sill":1.45,"via":"vano","muro":54},{"cod":"V-63","x":66.435,"y":105.824,"o":"V","ancho":1.89,"alto":1.99,"sill":1.45,"via":"vano","muro":54},{"cod":"V-60","x":55.765,"y":114.509,"o":"V","ancho":2.16,"alto":1.99,"sill":1.45,"via":"vano","muro":25},{"cod":"V-62","x":66.435,"y":102.834,"o":"V","ancho":2.01,"alto":1.99,"sill":1.45,"via":"vano","muro":54},{"cod":"V-68","x":66.435,"y":111.465,"o":"V","ancho":1.26,"alto":0.79,"sill":2.65,"via":"vano","muro":54},{"cod":"V-62","x":66.435,"y":114.589,"o":"V","ancho":2.0,"alto":1.99,"sill":1.45,"via":"vano","muro":54},{"cod":"V-67","x":66.435,"y":120.654,"o":"V","ancho":1.27,"alto":0.79,"sill":2.65,"via":"vano","muro":54},{"cod":"V-59","x":61.099,"y":92.774,"o":"H","ancho":2.561,"alto":0.79,"sill":2.65,"via":"vano","muro":0},{"cod":"V-66","x":55.765,"y":109.109,"o":"V","ancho":1.361,"alto":0.79,"sill":2.65,"via":"vano","muro":25},{"cod":"V-60","x":64.5,"y":92.774,"o":"H","ancho":2.16,"alto":1.99,"sill":1.45,"via":"vano","muro":0},{"cod":"V-67","x":66.435,"y":99.709,"o":"V","ancho":1.26,"alto":0.79,"sill":2.65,"via":"vano","muro":54},{"cod":"V-68","x":66.435,"y":97.434,"o":"V","ancho":1.211,"alto":0.79,"sill":2.65,"via":"vano","muro":54},{"cod":"V-60","x":57.7,"y":92.774,"o":"H","ancho":2.16,"alto":1.99,"sill":1.45,"via":"vano","muro":0},{"cod":"V-50","x":55.765,"y":94.369,"o":"V","ancho":1.481,"alto":0.79,"sill":2.65,"via":"vano","muro":25},{"cod":"V-49","x":66.435,"y":94.484,"o":"V","ancho":1.71,"alto":1.99,"sill":1.45,"via":"vano","muro":54},{"cod":"V-66","x":55.765,"y":111.384,"o":"V","ancho":1.11,"alto":0.79,"sill":2.65,"via":"vano","muro":25}],"techos":[{"rect":[54.185,91.194,68.015,129.324],"base":3.85,"pend":0.3,"eje":"y"}],"hastiales":[[[55.7,92.784,3.85],[55.7,92.784,4.285],[61.1,92.784,5.905],[66.5,92.784,4.285],[66.5,92.784,3.85]],[[55.7,127.734,3.85],[55.7,127.734,4.285],[61.1,127.734,5.905],[66.5,127.734,4.285],[66.5,127.734,3.85]]],"aberturas_techo":[],"celosias":[]},{"cod":"E-09","nombre":"","npt":0.15,"piso":[2.35,74.239,10.55,88.389],"muros":[[3.99,75.504,8.91,75.504,0.13,0.15,3.85,true],[3.84,79.374,9.06,79.374,0.13,0.15,3.85,false],[3.68,81.294,9.22,81.294,0.13,0.15,3.85,false],[3.84,83.254,9.06,83.254,0.13,0.15,3.85,false],[3.68,85.214,9.22,85.214,0.13,0.15,3.85,false],[3.99,87.124,8.91,87.124,0.13,0.15,3.85,true],[3.615,75.879,3.615,86.749,0.13,0.15,3.85,true],[5.32,81.374,5.32,83.174,0.1,0.15,3.85,false],[5.32,83.334,5.32,85.134,0.1,0.15,3.85,false],[6.45,81.229,6.45,85.029,0.13,0.15,3.85,false],[6.45,85.149,6.45,85.279,0.13,0.15,3.85,false],[7.105,87.059,7.105,87.189,0.25,0.15,3.85,false],[7.58,81.374,7.58,83.174,0.1,0.15,3.85,false],[7.58,83.334,7.58,85.134,0.1,0.15,3.85,false],[9.285,75.879,9.285,86.789,0.13,0.15,3.85,true]],"vigas":[[3.99,75.504,8.91,75.504,0.15,3.44,3.85],[3.84,79.374,9.06,79.374,0.15,3.44,3.85],[3.68,81.294,9.22,81.294,0.15,3.44,3.85],[3.84,83.254,9.06,83.254,0.15,3.44,3.85],[3.68,85.214,9.22,85.214,0.15,3.44,3.85],[3.99,87.124,8.91,87.124,0.15,3.44,3.85],[3.615,75.879,3.615,86.749,0.15,3.44,3.85],[5.32,81.374,5.32,83.174,0.12,3.44,3.85],[5.32,83.334,5.32,85.134,0.12,3.44,3.85],[6.45,81.229,6.45,85.029,0.15,3.44,3.85],[6.45,85.149,6.45,85.279,0.15,3.44,3.85],[7.105,87.059,7.105,87.189,0.27,3.44,3.85],[7.58,81.374,7.58,83.174,0.12,3.44,3.85],[7.58,83.334,7.58,85.134,0.12,3.44,3.85],[9.285,75.879,9.285,86.789,0.15,3.44,3.85]],"columnas":[[3.75,75.639,0.4,0.4,0.15,3.85],[3.675,79.239,0.25,0.4,0.15,3.85],[3.675,83.389,0.25,0.4,0.15,3.85],[3.75,86.989,0.4,0.4,0.15,3.85],[9.15,75.639,0.4,0.4,0.15,3.85],[9.225,79.239,0.25,0.4,0.15,3.85],[9.225,83.389,0.25,0.4,0.15,3.85],[9.15,86.989,0.4,0.4,0.15,3.85]],"puertas":[{"cod":"P-5","x":8.755,"y":85.214,"o":"H","ancho":0.9,"alto":2.5,"sill":0.15,"sobreluz":0.0,"vidrio":false,"via":"vano","muro":4},{"cod":"P-8","x":4.045,"y":85.214,"o":"H","ancho":0.7,"alto":2.5,"sill":0.15,"sobreluz":0.0,"vidrio":false,"via":"vano","muro":4},{"cod":"P-5","x":8.755,"y":81.294,"o":"H","ancho":0.9,"alto":2.5,"sill":0.15,"sobreluz":0.0,"vidrio":false,"via":"vano","muro":2},{"cod":"P-8","x":4.045,"y":81.294,"o":"H","ancho":0.7,"alto":2.5,"sill":0.15,"sobreluz":0.0,"vidrio":false,"via":"vano","muro":2},{"cod":"P-9","x":9.285,"y":78.124,"o":"V","ancho":1.8,"alto":2.5,"sill":0.15,"sobreluz":0.785,"vidrio":false,"via":"vano","muro":14},{"cod":"P-4","x":9.285,"y":79.954,"o":"V","ancho":1.0,"alto":2.5,"sill":0.15,"sobreluz":0.785,"vidrio":false,"via":"vano","muro":14},{"cod":"P-4","x":9.285,"y":86.274,"o":"V","ancho":1.0,"alto":2.5,"sill":0.15,"sobreluz":0.785,"vidrio":false,"via":"vano","muro":14}],"ventanas":[{"cod":"V-73","x":9.285,"y":76.544,"o":"V","ancho":0.77,"alto":0.79,"sill":2.65,"via":"vano","muro":14},{"cod":"V-59","x":3.615,"y":85.189,"o":"V","ancho":2.561,"alto":0.79,"sill":2.65,"via":"vano","muro":6},{"cod":"V-59","x":3.615,"y":77.439,"o":"V","ancho":2.561,"alto":0.79,"sill":2.65,"via":"vano","muro":6},{"cod":"V-27","x":9.285,"y":84.694,"o":"V","ancho":1.57,"alto":0.79,"sill":2.65,"via":"vano","muro":14},{"cod":"V-71","x":3.615,"y":81.314,"o":"V","ancho":3.11,"alto":0.79,"sill":2.65,"via":"vano","muro":6},{"cod":"V-72","x":9.285,"y":81.81,"o":"V","ancho":2.12,"alto":0.79,"sill":2.65,"via":"vano","muro":14}],"techos":[{"rect":[2.035,73.724,10.865,88.504],"base":3.85,"pend":0.3,"eje":"y"}],"hastiales":[[[3.55,75.514,3.85],[3.55,75.514,4.285],[6.45,75.514,5.155],[9.35,75.514,4.285],[9.35,75.514,3.85]],[[3.55,87.114,3.85],[3.55,87.114,4.285],[6.45,87.114,5.155],[9.35,87.114,4.285],[9.35,87.114,3.85]]],"aberturas_techo":[],"celosias":[]}],"losa":{"rect":[3.5,92.6,26.6,127.0],"h_col":6.0,"flecha":4.2,"columnas":[[3.5,92.6],[26.6,92.6],[3.5,98.333],[26.6,98.333],[3.5,104.067],[26.6,104.067],[3.5,109.8],[26.6,109.8],[3.5,115.533],[26.6,115.533],[3.5,121.267],[26.6,121.267],[3.5,127.0],[26.6,127.0]]},"oe01":{"gx0":31.3,"gx1":45.1,"yf":16.1,"yb":21.5,"columnas":[[31.441,16.3],[31.441,21.3],[33.388,16.3],[33.388,21.3],[38.295,16.3],[38.295,21.3],[40.262,16.3],[40.262,21.3],[44.959,16.3],[44.959,21.3]],"m1":[33.518,16.25,38.165,21.35],"caseta":[38.325,16.4,40.232,21.35]},"cerco":[[1.05,18.0,31.3,18.0],[45.1,18.0,71.76,18.0],[71.76,18.0,71.76,131.21],[71.76,131.21,1.05,131.21],[1.05,131.21,1.05,18.0]],"pisos":{"veredas":[[[[44.08,54.905],[44.095,41.59],[53.795,41.59],[53.81,54.905],[53.81,41.575],[44.08,41.575]]],[[[63.205,78.669],[70.205,78.669],[70.205,56.844],[63.205,56.844]]],[[[44.08,56.674],[44.08,88.004],[44.095,56.688],[60.795,56.688],[60.81,88.004],[60.81,56.674]]],[[[28.185,88.004],[41.685,88.004],[41.685,77.709],[28.185,77.709]]],[[[54.485,129.024],[67.715,129.024],[67.715,91.494],[54.485,91.494]],[[67.7,129.009],[54.5,129.009],[54.5,91.509],[67.7,91.509]]],[[[51.635,129.024],[53.835,129.024],[53.835,122.424],[51.635,122.424]]]],"pavimento":[[[[2.148,18.0],[2.103,127.095],[2.703,127.105],[2.686,130.765],[70.08,130.768],[70.085,88.011],[63.205,88.004],[63.205,56.844],[70.196,56.844],[70.205,55.101],[
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"verdes":[[[[27.439,18.001],[27.439,18.904],[29.807,20.305],[30.8,18.675],[30.8,18.001]]],[[[10.911,18.001],[10.911,20.308],[11.961,20.307],[12.839,18.001]]],[[[2.723,48.574],[
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"plaza":[[[[29.7,55.9],[40.2,55.9],[40.2,69.4],[29.7,69.4]]]]},"arboles":[[48.81,19.47],[68.31,19.44],[27.85,18.36],[45.75,19.47],[6.16,43.72],[6.16,38.23],[6.16,32.24],[5.35,20.21],[6.0,52],[6.0,60],[6.0,68],[2.5,46],[66,33],[66,45],[66,56],[66,70],[66,82],[28,60],[29,90],[52,90],[48.5,114],[60,112],[28.8,18.8],[58,19.3]],"medidas":{"PEND":0.3,"FONDO_VIGA":3.44}}'''
# Modelo nativo del Hogar de Refugio Temporal (CUI 2675514) - Revit + Dynamo (nodo Python Script, CPython3 o PythonNet3)
# Correr UNA vez en un proyecto nuevo (plantilla de arquitectura), con las familias de puerta, ventana, columna y vegetación
# cargadas. Medidas en metros (se pasan a pies). Origen local = E 349 090, N 9 281 900 (mismo origen del IFC complementario).
import clr, json, math
clr.AddReference('RevitAPI'); clr.AddReference('RevitServices')
from Autodesk.Revit.DB import *
from Autodesk.Revit.DB.Structure import StructuralType
from Autodesk.Revit.DB.Visual import *
from RevitServices.Persistence import DocumentManager
from RevitServices.Transactions import TransactionManager
from System.Collections.Generic import List

import traceback
doc = DocumentManager.Instance.CurrentDBDocument
D = json.loads(DATOS_JSON)
LOG = []
cuenta = {}
def _principal():
    M = D['medidas']
    FT = 1 / 0.3048
    def ft(v): return v * FT
    def P(x, y, z=0.0): return XYZ(ft(x), ft(y), ft(z))
    def nota(t): LOG.append(t)

    TransactionManager.Instance.EnsureInTransaction(doc)

    # ---------------- nivel
    niveles = sorted(FilteredElementCollector(doc).OfClass(Level).ToElements(), key=lambda l: abs(l.Elevation))
    NIV = niveles[0] if niveles else Level.Create(doc, 0.0)

    # ---------------- materiales con color (sombreado) y apariencia (realista)
    PLANTILLA_APAR = None
    for a in FilteredElementCollector(doc).OfClass(AppearanceAssetElement).ToElements():
        try:
            if a.GetRenderingAsset().FindByName('generic_diffuse') is not None:
                PLANTILLA_APAR = a; break
        except Exception:
            pass
    MATS = {}
    def material(nombre, rgb):
        if nombre in MATS: return MATS[nombre]
        ex = [m for m in FilteredElementCollector(doc).OfClass(Material).ToElements() if m.Name == nombre]
        mat = ex[0] if ex else doc.GetElement(Material.Create(doc, nombre))
        mat.Color = Color(rgb[0], rgb[1], rgb[2]); mat.UseRenderAppearanceForShading = False
        if PLANTILLA_APAR is not None and not ex:
            try:
                ap = PLANTILLA_APAR.Duplicate('Apar ' + nombre)
                esc = AppearanceAssetEditScope(doc)
                asset = esc.Start(ap.Id)
                asset.FindByName('generic_diffuse').SetValueAsColor(Color(rgb[0], rgb[1], rgb[2]))
                esc.Commit(True); esc.Dispose()
                mat.AppearanceAssetId = ap.Id
            except Exception as ex_:
                nota('apariencia %s: %s' % (nombre, ex_))
        MATS[nombre] = mat.Id
        return mat.Id

    TP1 = material('HR TP-1 Guinda', (123, 31, 45)); TP2 = material('HR TP-2 Gris', (125, 133, 139))
    TP3 = material('HR TP-3 Blanco RAL 9010', (241, 236, 225)); CONC = material('HR Concreto', (186, 182, 174))
    VER = material('HR Vereda', (190, 186, 178)); CAL = material('HR Calamina', (196, 200, 204))
    PASTO = material('HR Area verde', (88, 128, 58)); ACERO = material('HR Acero', (110, 115, 120))
    ADOQ = material('HR Adoquin', (150, 92, 74)); CANCHA = material('HR Losa deportiva', (150, 62, 52))

    # ---------------- tipos de muro, piso y cubierta de una capa
    def tipo(clase, base_nombre, nombre, ancho, mat, funcion=MaterialFunctionAssignment.Structure):
        """Tipo de una sola capa (espesor y material); si ya existe (corrida anterior) se le vuelve a fijar la capa."""
        ex = [t for t in FilteredElementCollector(doc).OfClass(clase).ToElements() if t.Name == nombre]
        if ex:
            t = ex[0]
        else:
            bases = [t for t in FilteredElementCollector(doc).OfClass(clase).ToElements()
                     if (clase != WallType or t.Kind == WallKind.Basic) and t.GetCompoundStructure() is not None]
            t = doc.GetElement(bases[0].Duplicate(nombre).Id)
        errores = []
        # 1) la estructura del tipo base con una sola capa (núcleo) del espesor y material pedidos
        try:
            cs = t.GetCompoundStructure()
            capas = List[CompoundStructureLayer]()
            capas.Add(CompoundStructureLayer(ft(ancho), funcion, mat))
            cs.SetLayers(capas)
            cs.SetNumberOfShellLayers(ShellLayerType.Exterior, 0)
            cs.SetNumberOfShellLayers(ShellLayerType.Interior, 0)
            try: cs.StructuralMaterialIndex = 0
            except Exception: pass
            t.SetCompoundStructure(cs)
            return t
        except Exception as ex_:
            errores.append(str(ex_).split('\n')[0])
        # 2) estructura nueva de una capa
        try:
            t.SetCompoundStructure(CompoundStructure.CreateSingleLayerCompoundStructure(funcion, ft(ancho), mat))
            return t
        except Exception as ex_:
            errores.append(str(ex_).split('\n')[0])
        # 3) solo el material en todas las capas del tipo base (espesor del tipo base)
        try:
            cs = t.GetCompoundStructure()
            for i in range(cs.LayerCount): cs.SetMaterialId(i, mat)
            t.SetCompoundStructure(cs)
        except Exception as ex_:
            errores.append(str(ex_).split('\n')[0])
        nota('%s: %s' % (nombre, ' | '.join(errores)))
        return t

    W_TP2 = tipo(WallType, '', 'HR-Muro TP-2 e=0.15', 0.15, TP2)
    W_VIGA = tipo(WallType, '', 'HR-Viga collar TP-1 0.23', 0.23, TP1)
    W_HAST = tipo(WallType, '', 'HR-Hastial TP-3 e=0.20', 0.20, TP3)
    W_CERCO = tipo(WallType, '', 'HR-Cerco TP-3 e=0.15', 0.15, TP3)
    W_ZOC = tipo(WallType, '', 'HR-Zocalo cerco TP-2 e=0.17', 0.17, TP2)
    W_PARA = tipo(WallType, '', 'HR-Parapeto PL-2 TP-3 e=0.35', 0.35, TP3)
    W_LAT = tipo(WallType, '', 'HR-Muro lateral OE-01 TP-2 e=0.20', 0.20, TP2)
    F_PISO = tipo(FloorType, '', 'HR-Piso concreto e=0.15', 0.15, CONC)
    F_VER = tipo(FloorType, '', 'HR-Vereda e=0.10', 0.10, VER)
    F_PAV = tipo(FloorType, '', 'HR-Pavimento concreto e=0.10', 0.10, CONC)
    F_VERDE = tipo(FloorType, '', 'HR-Area verde e=0.05', 0.05, PASTO)
    F_ADOQ = tipo(FloorType, '', 'HR-Patio civico adoquin e=0.12', 0.12, ADOQ)
    F_LOSA = tipo(FloorType, '', 'HR-Losa deportiva e=0.12', 0.12, CANCHA)
    R_CAL = tipo(RoofType, '', 'HR-Cobertura calamina e=0.05', 0.05, CAL)
    R_LOSA = tipo(RoofType, '', 'HR-Cobertura losa OE-01 e=0.20', 0.20, CONC)

    # ---------------- utilidades
    def lazo(pts):
        cl = CurveLoop()
        for i in range(len(pts)):
            a = pts[i]; b = pts[(i + 1) % len(pts)]
            if a.DistanceTo(b) > 0.003: cl.Append(Line.CreateBound(a, b))
        return cl

    def piso(anillos, ftipo, z_sup):
        n = 0
        for poli in anillos:
            try:
                loops = List[CurveLoop]()
                for r in poli: loops.Add(lazo([P(x, y) for x, y in r]))
                fl = Floor.Create(doc, loops, ftipo.Id, NIV.Id)
                fl.get_Parameter(BuiltInParameter.FLOOR_HEIGHTABOVELEVEL_PARAM).Set(ft(z_sup))
                n += 1
            except Exception as ex_:
                nota('piso %s: %s' % (ftipo.Name, ex_))
        return n

    def muro(x0, y0, x1, y1, wtipo, z0, h):
        w = Wall.Create(doc, Line.CreateBound(P(x0, y0), P(x1, y1)), wtipo.Id, NIV.Id, ft(h), ft(z0), False, False)
        return w

    def muro_perfil(pts, wtipo):
        c = List[Curve]()
        for i in range(len(pts)):
            a = P(*pts[i]); b = P(*pts[(i + 1) % len(pts)])
            if a.DistanceTo(b) > 0.003: c.Add(Line.CreateBound(a, b))
        return Wall.Create(doc, c, wtipo.Id, NIV.Id, False)

    def solido(x0, y0, z0, x1, y1, z1, mat, cat, nombre):
        """Caja como DirectShape (categoría nativa con material), para piezas que no tienen familia en el proyecto."""
        loops = List[CurveLoop](); loops.Add(lazo([P(x0, y0, z0), P(x1, y0, z0), P(x1, y1, z0), P(x0, y1, z0)]))
        so = SolidOptions(mat, ElementId.InvalidElementId)
        s = GeometryCreationUtilities.CreateExtrusionGeometry(loops, XYZ.BasisZ, ft(z1 - z0), so)
        ds = DirectShape.CreateElement(doc, ElementId(cat))
        g = List[GeometryObject](); g.Add(s); ds.SetShape(g); ds.Name = nombre
        return ds

    def simbolo(cat, claves, nombre_tipo, dims=(), mat=None):
        """Tipo de familia cargada: el primero cuyo nombre tenga una de las claves; se duplica con las medidas pedidas.
        dims = [(valor_m, [nombres de parámetro], [BuiltInParameter])]."""
        sims = [s for s in FilteredElementCollector(doc).OfCategory(cat).OfClass(FamilySymbol).ToElements()]
        if not sims: return None
        elegido = None
        for k in claves:
            for s in sims:
                if k.lower() in (s.FamilyName + ' ' + s.Name).lower(): elegido = s; break
            if elegido: break
        elegido = elegido or sims[0]
        ex = [s for s in sims if s.Name == nombre_tipo and s.FamilyName == elegido.FamilyName]
        if ex: s = ex[0]
        else:
            s = doc.GetElement(elegido.Duplicate(nombre_tipo).Id)
            for val, nombres, bips in dims:
                p = None
                for b in bips:
                    q = s.get_Parameter(b)
                    if q is not None and not q.IsReadOnly: p = q; break
                if p is None:
                    for n in nombres:
                        q = s.LookupParameter(n)
                        if q is not None and not q.IsReadOnly: p = q; break
                if p is not None: p.Set(ft(val))
                else: nota('%s: sin parámetro %s' % (nombre_tipo, nombres[0]))
            if mat is not None:
                q = s.LookupParameter('Material')
                if q is not None and not q.IsReadOnly: q.Set(mat)
        if not s.IsActive: s.Activate()
        return s

    S_COL = {}
    def columna(x, y, b, h, z0, z1, mat, nombre):
        k = (b, h, mat.IntegerValue if hasattr(mat, 'IntegerValue') else str(mat))
        if k not in S_COL:
            S_COL[k] = simbolo(BuiltInCategory.OST_Columns, ('rectangular', 'rectangle'), 'HR-Columna %.2fx%.2f %s' % (b, h, doc.GetElement(mat).Name),
                               [(b, ['Width', 'Ancho', 'b'], []), (h, ['Depth', 'Profundidad', 'h'], [])], mat)
        s = S_COL[k]
        if s is not None:
            try:
                c = doc.Create.NewFamilyInstance(P(x, y, 0), s, NIV, StructuralType.NonStructural)
                for bip, val in ((BuiltInParameter.FAMILY_BASE_LEVEL_OFFSET_PARAM, ft(z0)), (BuiltInParameter.FAMILY_TOP_LEVEL_OFFSET_PARAM, ft(z1))):
                    q = c.get_Parameter(bip)
                    if q is not None and not q.IsReadOnly: q.Set(val)
                q = c.get_Parameter(BuiltInParameter.FAMILY_TOP_LEVEL_PARAM)
                if q is not None and not q.IsReadOnly: q.Set(NIV.Id)
                return c
            except Exception as ex_:
                nota('columna familia: %s' % ex_)
        return solido(x - b / 2, y - h / 2, z0, x + b / 2, y + h / 2, z1, mat, BuiltInCategory.OST_Columns, nombre)

    def techo_huella(rect, base, pend, eje, rtipo):
        x0, y0, x1, y1 = rect
        ca = CurveArray()
        for a, b in ((P(x0, y0), P(x1, y0)), (P(x1, y0), P(x1, y1)), (P(x1, y1), P(x0, y1)), (P(x0, y1), P(x0, y0))):
            ca.Append(Line.CreateBound(a, b))
        try:
            res = doc.Create.NewFootPrintRoof(ca, NIV, rtipo, ModelCurveArray())
        except Exception:
            res = doc.Create.NewFootPrintRoof(ca, NIV, rtipo)
        roof = res[0] if isinstance(res, tuple) else res
        roof.get_Parameter(BuiltInParameter.ROOF_LEVEL_OFFSET_PARAM).Set(ft(base))
        for arr in roof.GetProfiles():
            for mc in arr:
                ln = mc.GeometryCurve; d = ln.GetEndPoint(1) - ln.GetEndPoint(0)
                paralelo_y = abs(d.Y) > abs(d.X)
                define = (eje == 'y' and paralelo_y) or (eje == 'x' and not paralelo_y)
                if eje == 'una':
                    define = abs(ln.GetEndPoint(0).Y - ft(y1)) < 0.01 and abs(ln.GetEndPoint(1).Y - ft(y1)) < 0.01
                try:
                    roof.set_DefinesSlope(mc, define)
                    if define: roof.set_SlopeAngle(mc, pend)
                except Exception:
                    roof.DefinesSlope[mc] = define
                    if define: roof.SlopeAngle[mc] = pend
        return roof

    def suma(k, n=1): cuenta[k] = cuenta.get(k, 0) + n

    # ---------------- edificaciones E-01 a E-09 (muros, vanos, alturas y coberturas leídos de los planos)
    W_MURO = {}
    def tipo_muro(e_):
        k = round(e_, 2)
        if k not in W_MURO: W_MURO[k] = tipo(WallType, '', 'HR-Muro TP-2 e=%.2f' % k, k, TP2)
        return W_MURO[k]
    W_CEL = tipo(WallType, '', 'HR-Celosia sobretecho TP-1 e=0.05', 0.05, TP1)

    S_PUERTA = {}; S_VENT = {}
    def familia_puerta(ancho, alto, vidrio):
        k = (ancho, alto, vidrio)
        if k not in S_PUERTA:
            S_PUERTA[k] = simbolo(BuiltInCategory.OST_Doors, ('double glass', 'doble', 'glass', 'vidrio') if vidrio else ('single-flush', 'single', 'simple'),
                                  'HR-Puerta %.2fx%.2f%s' % (ancho, alto, ' vidrio' if vidrio else ''),
                                  [(ancho, ['Width', 'Ancho'], [BuiltInParameter.DOOR_WIDTH, BuiltInParameter.FAMILY_WIDTH_PARAM]),
                                   (alto, ['Height', 'Altura'], [BuiltInParameter.DOOR_HEIGHT, BuiltInParameter.FAMILY_HEIGHT_PARAM])])
        return S_PUERTA[k]

    def familia_ventana(ancho, alto, fija=False):
        k = (ancho, alto, fija)
        if k not in S_VENT:
            S_VENT[k] = simbolo(BuiltInCategory.OST_Windows, ('fixed', 'fija', 'sliding', 'corrediza') if fija else ('sliding', 'corrediza', 'fixed', 'fija'),
                                'HR-%s %.2fx%.2f' % ('Sobreluz' if fija else 'Ventana', ancho, alto),
                                [(ancho, ['Width', 'Ancho'], [BuiltInParameter.WINDOW_WIDTH, BuiltInParameter.FAMILY_WIDTH_PARAM]),
                                 (alto, ['Height', 'Altura'], [BuiltInParameter.WINDOW_HEIGHT, BuiltInParameter.FAMILY_HEIGHT_PARAM])])
        return S_VENT[k]

    def vano(s, host, v, sill):
        fi = doc.Create.NewFamilyInstance(P(v['x'], v['y'], sill), s, host, NIV, StructuralType.NonStructural)
        pa = fi.get_Parameter(BuiltInParameter.INSTANCE_SILL_HEIGHT_PARAM)
        if pa is not None and not pa.IsReadOnly: pa.Set(ft(sill))
        return fi

    for e in D['edificios']:
        try:
            p_ = e['piso']
            piso([[[[p_[0], p_[1]], [p_[2], p_[1]], [p_[2], p_[3]], [p_[0], p_[3]]]]], F_PISO, e['npt'])
            muros = []
            for (x0, y0, x1, y1, esp, z0, z1, ext), vg in zip(e['muros'], e['vigas']):
                fondo = vg[5]                                              # el muro llega al fondo de la viga; encima, la viga TP-1
                w = muro(x0, y0, x1, y1, tipo_muro(esp), z0, fondo - z0); muros.append(w); suma('muros')
                for extremo in (0, 1):                                     # los muros llegan a tope a columnas y a otros muros:
                    try: WallUtils.DisallowWallJoinAtEnd(w, extremo)       # sin uniones automáticas ("Can't keep elements joined")
                    except Exception: pass
                a = vg[4] / 2
                if abs(y0 - y1) < 1e-6:
                    solido(min(x0, x1), y0 - a, fondo, max(x0, x1), y0 + a, vg[6], TP1, BuiltInCategory.OST_StructuralFraming, e['cod'] + ' viga TP-1')
                else:
                    solido(x0 - a, min(y0, y1), fondo, x0 + a, max(y0, y1), vg[6], TP1, BuiltInCategory.OST_StructuralFraming, e['cod'] + ' viga TP-1')
                suma('vigas')
            cols = []
            for (x, y, b, h, z0, z1) in e['columnas']:
                cols.append(columna(x, y, round(b, 2), round(h, 2), z0, z1, TP1, e['cod'] + ' columna TP-1')); suma('columnas')
            doc.Regenerate()
            for c in cols:                                                 # la columna queda en TP-1 (no toma el material del muro)
                for w in muros:
                    try:
                        if JoinGeometryUtils.AreElementsJoined(doc, c, w): JoinGeometryUtils.UnjoinGeometry(doc, c, w)
                    except Exception: pass
            for v in e['puertas']:
                try:
                    s = familia_puerta(v['ancho'], v['alto'], v['vidrio'])
                    if s is None: nota('sin familia de puerta cargada'); continue
                    vano(s, muros[v['muro']], v, v['sill']); suma('puertas')
                    hs = round(M['FONDO_VIGA'] - (v['sill'] + v['alto']), 3)
                    if v['sobreluz'] and hs > 0.2:                         # sobreluz fija sobre la puerta, hasta el fondo de la viga
                        s2 = familia_ventana(v['ancho'], hs, True)
                        if s2 is not None: vano(s2, muros[v['muro']], v, v['sill'] + v['alto']); suma('sobreluces')
                except Exception as ex_:
                    nota('%s puerta %s: %s' % (e['cod'], v['cod'], ex_))
            for v in e['ventanas']:
                try:
                    s = familia_ventana(v['ancho'], v['alto'])
                    if s is None: nota('sin familia de ventana cargada'); continue
                    vano(s, muros[v['muro']], v, v['sill']); suma('ventanas')
                except Exception as ex_:
                    nota('%s ventana %s: %s' % (e['cod'], v['cod'], ex_))
            for h in e['hastiales']:
                try: muro_perfil(h, W_HAST); suma('hastiales')
                except Exception as ex_: nota('%s hastial: %s' % (e['cod'], ex_))
            techo_ppal = None
            for t in e['techos']:
                try:
                    r_ = techo_huella(t['rect'], t['base'], t['pend'], t['eje'], R_CAL); suma('cubiertas a dos aguas')
                    if not t.get('sobretecho') and techo_ppal is None: techo_ppal = r_
                except Exception as ex_:
                    nota('%s cubierta: %s' % (e['cod'], ex_))
            for (x0, y0, x1, y1) in e['aberturas_techo']:                 # lucernario bajo el sobretecho (E-01)
                try:
                    doc.Regenerate()
                    ca = CurveArray()
                    for a, b in ((P(x0, y0), P(x1, y0)), (P(x1, y0), P(x1, y1)), (P(x1, y1), P(x0, y1)), (P(x0, y1), P(x0, y0))):
                        ca.Append(Line.CreateBound(a, b))
                    doc.Create.NewOpening(techo_ppal, ca, True); suma('aberturas de cobertura')
                except Exception as ex_:
                    nota('%s abertura de cobertura: %s' % (e['cod'], ex_))
            for c in e['celosias']:
                try: muro_perfil(c, W_CEL); suma('celosias')
                except Exception as ex_: nota('%s celosia: %s' % (e['cod'], ex_))
        except Exception as ex_:
            nota('%s: %s' % (e['cod'], ex_))

    # ---------------- losa deportiva OC-06: losa, columnas y cubierta en arco
    L = D['losa']; x0, y0, x1, y1 = L['rect']
    try:
        piso([[[[x0, y0], [x1, y0], [x1, y1], [x0, y1]]]], F_LOSA, 0.12)
        for (x, y) in L['columnas']:
            columna(x, y, 0.36, 0.36, 0.12, L['h_col'], ACERO, 'OC-06 columna'); suma('columnas')
        rp = doc.Create.NewReferencePlane(P(x1, y0, 0), P(x0, y0, 0), XYZ.BasisZ, doc.ActiveView)
        ca = CurveArray()
        ca.Append(Arc.Create(P(x0, y0, L['h_col']), P(x1, y0, L['h_col']), P((x0 + x1) / 2, y0, L['h_col'] + L['flecha'])))
        doc.Regenerate()
        Lx = ft(y1 - y0)                                               # la extrusión va según la normal del plano: hacia +Y
        e0, e1 = (0.0, Lx) if rp.Normal.Y > 0 else (-Lx, 0.0)
        techo_arco = doc.Create.NewExtrusionRoof(ca, rp, NIV, R_CAL, e0, e1); suma('cubierta en arco')
        doc.Regenerate()
        bb = techo_arco.get_BoundingBox(None)                           # comprobación: debe quedar sobre la losa deportiva
        if bb is not None and (bb.Min.Y < ft(y0) - 1.0 or bb.Max.Y > ft(y1) + 1.0):
            ElementTransformUtils.MoveElement(doc, techo_arco.Id, XYZ(0, ft(y0) - bb.Min.Y, 0))
            nota('cubierta en arco reubicada sobre la losa deportiva')
    except Exception as ex_:
        nota('losa deportiva: %s' % ex_)

    # ---------------- pórtico de ingreso OE-01
    O = D['oe01']; gx0, gx1, yf, yb = O['gx0'], O['gx1'], O['yf'], O['yb']
    try:
        piso([[[[gx0 - 0.5, yf - 0.6], [gx1 + 0.5, yf - 0.6], [gx1 + 0.5, yb + 0.6], [gx0 - 0.5, yb + 0.6]]]], F_VER, 0.05)
        for (x, y) in O['columnas']:
            columna(x, y, 0.26, 0.40, 0.05, 4.18, TP1, 'OE-01 columna C-1'); suma('columnas')
        solido(gx0, yf, 4.18, gx1, yf + 0.4, 4.71, TP1, BuiltInCategory.OST_StructuralFraming, 'OE-01 viga VG-1')
        solido(gx0, yf + 0.05, 4.71, gx1, yf + 0.4, 5.09, TP2, BuiltInCategory.OST_GenericModel, 'OE-01 cielo CR-1')
        solido(gx0, yb - 0.4, 3.55, gx1, yb, 4.19, TP1, BuiltInCategory.OST_StructuralFraming, 'OE-01 viga posterior')
        muro(gx0 - 0.05, yf + 0.125, gx1 + 0.05, yf + 0.125, W_PARA, 5.09, 0.86)
        muro(gx0 - 0.05, yb - 0.10, gx1 + 0.05, yb - 0.10, W_PARA, 4.19, 0.60)
        for xx, s in ((gx0 + 0.1, 1), (gx1 - 0.1, -1)):
            muro_perfil([[xx, yf, 0.05], [xx, yb, 0.05], [xx, yb, 4.19], [xx, yf, 5.72]], W_LAT); suma('muros')
        m = O['m1']; solido(m[0], m[1], 0.05, m[2], m[3], 4.18, TP2, BuiltInCategory.OST_GenericModel, 'OE-01 muro M-1 (SS.HH.)')
        c = O['caseta']; solido(c[0], c[1], 0.05, c[2], c[3], 3.5, TP2, BuiltInCategory.OST_GenericModel, 'OE-01 caseta de vigilancia')
        techo_huella([gx0, yf + 0.3, gx1, yb - 0.2], 4.19, (5.72 - 4.19) / (yb - yf - 0.5), 'una', R_LOSA); suma('cubierta OE-01')
    except Exception as ex_:
        nota('OE-01: %s' % ex_)

    # ---------------- cerco perimétrico (muro TP-3, zócalo TP-2, columnas cada 3 m)
    for (xa, ya, xb, yb_) in D['cerco']:
        try:
            Lc = math.hypot(xb - xa, yb_ - ya)
            if Lc < 0.5: continue
            muro(xa, ya, xb, yb_, W_CERCO, 0.0, 2.43); muro(xa, ya, xb, yb_, W_ZOC, 0.0, 0.60); suma('tramos de cerco')
            nc = max(1, int(round(Lc / 3.0)))
            for k in range(nc + 1):
                t = float(k) / nc
                solido(xa + (xb - xa) * t - 0.14, ya + (yb_ - ya) * t - 0.14, 0.0, xa + (xb - xa) * t + 0.14, ya + (yb_ - ya) * t + 0.14, 2.5,
                       TP2, BuiltInCategory.OST_Columns, 'Columna de cerco')
        except Exception as ex_:
            nota('cerco: %s' % ex_)

    # ---------------- pisos exteriores
    Pz = D['pisos']
    suma('veredas', piso(Pz['veredas'], F_VER, 0.10)); suma('pavimento', piso(Pz['pavimento'], F_PAV, 0.08))
    suma('areas verdes', piso(Pz['verdes'], F_VERDE, 0.02)); suma('patio civico', piso(Pz['plaza'], F_ADOQ, 0.12))

    # ---------------- árboles (familia de vegetación RPC del proyecto)
    sims = [s for s in FilteredElementCollector(doc).OfCategory(BuiltInCategory.OST_Planting).OfClass(FamilySymbol).ToElements()]
    if sims:
        s = next((x for x in sims if 'tree' in (x.FamilyName + x.Name).lower() or 'arbol' in (x.FamilyName + x.Name).lower()), sims[0])
        if not s.IsActive: s.Activate()
        for (x, y) in D['arboles']:
            try: doc.Create.NewFamilyInstance(P(x, y, 0), s, NIV, StructuralType.NonStructural); suma('arboles')
            except Exception as ex_: nota('arbol: %s' % ex_)
    else:
        nota('No hay familia de vegetación cargada: Insertar > Cargar familia de Autodesk > Vegetación (RPC Tree) y volver a correr solo esta parte.')


TransactionManager.Instance.EnsureInTransaction(doc)
ERROR = None
try:
    _principal()
except Exception:
    ERROR = traceback.format_exc()
TransactionManager.Instance.TransactionTaskDone()
OUT = (['ERROR (copiar este texto):', ERROR] if ERROR else []) + ['%s: %d' % (k, v) for k, v in sorted(cuenta.items())] + ['--- avisos ---'] + LOG[:200]
# ----------------------------------------
